# Grasshopper definition 0.1_Rhino_Grasshopper_Python_WickersonStudios_Geometry_Surface_Revit2021_014.gh (Grasshopper 1.0.7)
# Copyright: bernhard muller bijoutiers
# plug-ins: Workshop

wickerson_s_first_grasshopper_component = WickersonsFirstGrasshopperComponent()  # disabled
surface = Surface(reparameterize(<surface referenced from the Rhino model>))
ghpython_script = GhPythonScript(
    surface=surface,
    uDiv=Slider(8, range=0..10),
    vDiv=Slider(8, range=0..10),
    scaleA=Slider(0.59, range=0..1),
    scaleB=Slider(0.43, range=0..1),
    depth=Slider(-67.12, range=-100..100.01),
    MD1=Slider(0.6, range=0..3),
    MD2=Slider(2.66, range=0..3))  # -> out, boxList_out; inputs surface: Surface, uDiv: Int32, vDiv: Int32
# ---------- ghpython_script: Python ----------
import rhinoscriptsyntax as rs #GUID
import Rhino.Geometry as rg #Geometries

boxList = []

domainU = rs.SurfaceDomain(surface,0)
domainV = rs.SurfaceDomain(surface,1)

du = (domainU[1]-domainU[0])/uDiv
dv = (domainV[1]-domainV[0])/vDiv

for i in range(uDiv):
    for j in range(vDiv):
        u = du*i,du*(i+1)
        v = dv*j,dv*(j+1)
        trimSurf = rs.TrimSurface(surface,2,[u,v])
        center = rs.SurfaceAreaCentroid(trimSurf)
        vector = rs.SurfaceNormal(trimSurf,[du*(i+MD1),dv*(j+MD2)])
        subSurfA = rs.ScaleObject(trimSurf,center[0],[scaleA,scaleA,scaleA],True)
        subSurfB = rs.ScaleObject(trimSurf,center[0],[scaleB,scaleB,scaleB],True)
        subSurfB = rs.CopyObject(subSurfB,vector*depth)
        
        edgeT = rs.DuplicateSurfaceBorder(trimSurf,1)
        edgeSA = rs.DuplicateSurfaceBorder(subSurfA,1)
        edgeSB = rs.DuplicateSurfaceBorder(subSurfB,1)
        
        flatA = rs.AddLoftSrf([edgeT,edgeSA],None,None,2)
        flatB = rs.AddLoftSrf([edgeSA,edgeSB],None,None,2)
        
        box = rs.JoinSurfaces([flatA,flatB,subSurfB])
        boxList.append(box)


boxList_out = boxList
# ---------- end ghpython_script ----------
# www.wickersonstudios.com
# www.michaelwickerson.com
# 
# youtube: Michael Wickerson
# gitHub: Mwickerson
# instagram: WickersonStudiosAR
brep = Brep(ghpython_script.boxList_out)
