# Grasshopper definition 0.1_Rhino_Grasshopper_Python_WickersonStudios_Geometry_Surface_Revit2021_015.gh (Grasshopper 1.0.7)
# Copyright: bernhard muller bijoutiers
# plug-ins: Workshop

wickerson_s_first_grasshopper_component = WickersonsFirstGrasshopperComponent()  # disabled
surface = Surface(<surface referenced from the Rhino model>)
ghpython_script = GhPythonScript(surface=surface, uDiv=Slider(18, range=0..30), vDiv=Slider(11, range=0..20), mult=Slider(10, range=0..10))  # -> out, curveA_out; inputs surface: Surface, uDiv: Int32, vDiv: Int32
# ---------- ghpython_script: Python ----------
import rhinoscriptsyntax as rs #GUID

def SampleSurfA(surf):
    domainU = rs.SurfaceDomain(surf,0)
    domainV = rs.SurfaceDomain(surf,1)
    du = (domainU[1]-domainU[0])/uDiv
    dv = (domainV[1]-domainV[0])/vDiv  
    
    pt = []
    for i in range(uDiv+1):
        rowList = []
        for j in range(vDiv+1):
            rowList.append(rs.EvaluateSurface(surf,du*i,dv*j))
        pt.append(rowList)
        
    return pt

ptA = SampleSurfA(surface)

curveA = []

for i in range(len(ptA)):
    if i % 2 ==0:
        pts = []
        for j in range(len(ptA[i])):
            normal = rs.SurfaceNormal(surface,ptA[i][j])
            if j % 2 == 0:
                newPt = rs.CopyObject(ptA[i][j],normal*mult)
                pts.append(newPt)
            else:
                newPt = rs.CopyObject(ptA[i][j],normal*-mult)
                pts.append(newPt)
        
        curve = rs.AddInterpCurve(pts)
        curveA.append(curve)
        
    else:
        pts = []
        for j in range(len(ptA[i])):
            normal = rs.SurfaceNormal(surface,ptA[i][j])
            if j % 2 == 0:
                newPt = rs.CopyObject(ptA[i][j],normal*-mult)
                pts.append(newPt)
            else:
                newPt = rs.CopyObject(ptA[i][j],normal*mult)
                pts.append(newPt)
        
        curve = rs.AddInterpCurve(pts)
        curveA.append(curve)

curveA_out = curveA
# ---------- end ghpython_script ----------
# www.wickersonstudios.com
# www.michaelwickerson.com
# 
# youtube: Michael Wickerson
# gitHub: Mwickerson
# instagram: WickersonStudiosAR
curve = Curve(ghpython_script.curveA_out)
