# Grasshopper definition 0.1_Rhino_Grasshopper_Python_WickersonStudios_Geometry_Surface_Revit2021_016.gh (Grasshopper 1.0.7)
# Copyright: bernhard muller bijoutiers
# plug-ins: Workshop

# www.wickersonstudios.com
# www.michaelwickerson.com
# 
# youtube: Michael Wickerson
# gitHub: Mwickerson
# instagram: WickersonStudiosAR
wickerson_s_first_grasshopper_component = WickersonsFirstGrasshopperComponent()  # disabled
number_slider = Slider(4.19, range=0..10)
surface = Surface(<surface referenced from the Rhino model>)
ghpython_script = GhPythonScript(surface=surface, uDiv=Slider(18, range=0..30), vDiv=Slider(11, range=0..20), mult=number_slider)  # -> out, curveA_out, curveB_out; inputs surface: Surface, uDiv: Int32, vDiv: Int32
# ---------- ghpython_script: Python ----------
import rhinoscriptsyntax as rs #GUID

def SampleSurfA(surf):
    domainU = rs.SurfaceDomain(surf,0)
    domainV = rs.SurfaceDomain(surf,1)
    du = (domainU[1]-domainU[0])/uDiv
    dv = (domainV[1]-domainV[0])/vDiv  
    
    pt = []
    for i in range(uDiv+1):
        rowList = []
        for j in range(vDiv+1):
            rowList.append(rs.EvaluateSurface(surf,du*i,dv*j))
        pt.append(rowList)
        
    return pt

ptA = SampleSurfA(surface)

curveA = []

for i in range(len(ptA)):
    if i % 2 ==0:
        pts = []
        for j in range(len(ptA[i])):
            normal = rs.SurfaceNormal(surface,ptA[i][j])
            if j % 2 == 0:
                newPt = rs.CopyObject(ptA[i][j],normal*mult)
                pts.append(newPt)
            else:
                newPt = rs.CopyObject(ptA[i][j],normal*-mult)
                pts.append(newPt)
        
        curve = rs.AddInterpCurve(pts)
        curveA.append(curve)
        
    else:
        pts = []
        for j in range(len(ptA[i])):
            normal = rs.SurfaceNormal(surface,ptA[i][j])
            if j % 2 == 0:
                newPt = rs.CopyObject(ptA[i][j],normal*-mult)
                pts.append(newPt)
            else:
                newPt = rs.CopyObject(ptA[i][j],normal*mult)
                pts.append(newPt)
        
        curve = rs.AddInterpCurve(pts)
        curveA.append(curve)

curveA_out = curveA

def SampleSurfB(surf):
    domainU = rs.SurfaceDomain(surf,0)
    domainV = rs.SurfaceDomain(surf,1)
    du = (domainU[1]-domainU[0])/uDiv
    dv = (domainV[1]-domainV[0])/vDiv  
    
    pt = []
    for j in range(vDiv+1):
        rowList = []
        for i in range(uDiv+1):
            rowList.append(rs.EvaluateSurface(surf,du*i,dv*j))
        pt.append(rowList)
        
    return pt

ptB = SampleSurfB(surface)

curveB = []

for i in range(len(ptB)):
    if i % 2 ==0:
        pts = []
        for j in range(len(ptB[i])):
            normal = rs.SurfaceNormal(surface,ptB[i][j])
            if j % 2 == 0:
                newPt = rs.CopyObject(ptB[i][j],normal*-mult)
                pts.append(newPt)
            else:
                newPt = rs.CopyObject(ptB[i][j],normal*mult)
                pts.append(newPt)
        
        curve = rs.AddInterpCurve(pts)
        curveB.append(curve)
        
    else:
        pts = []
        for j in range(len(ptB[i])):
            normal = rs.SurfaceNormal(surface,ptB[i][j])
            if j % 2 == 0:
                newPt = rs.CopyObject(ptB[i][j],normal*mult)
                pts.append(newPt)
            else:
                newPt = rs.CopyObject(ptB[i][j],normal*-mult)
                pts.append(newPt)
        
        curve = rs.AddInterpCurve(pts)
        curveB.append(curve)

curveB_out = curveB
# ---------- end ghpython_script ----------
range = Range(Domain=Domain(0, 1), Steps=10)
curve = Curve(ghpython_script.curveA_out)
curve_2 = Curve(ghpython_script.curveB_out)
graph_mapper = GraphMapper(
    range,
    x0=0,
    x1=1,
    y0=0,
    y1=1,
    container_name="Sine",
    Equation_px=[0.008695740253, 0.422608763],
    Equation_py=[0.1538461447, 0.9227691889])
multiplication = Multiplication(A=number_slider, B=graph_mapper)
pipe_variable = PipeVariable(Curve=reparameterize([curve, curve_2]), Parameters=range, Radii=multiplication, Caps="2")
