# Grasshopper definition 0.2_Rhino_Grasshopper_Python_WickersonStudios_Geometry_FlowSurface_2.0_Revit2021_023.gh (Grasshopper 1.0.7)
# Copyright: bernhard muller bijoutiers
# plug-ins: Workshop

number_slider = Slider(76, range=0..100)  # disabled
surface = Surface(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)  # disabled
ghpython_script = GhPythonScript(surface=surface, count=number_slider)  # -> out, pts_out; inputs surface: Surface, count: Int32; disabled
# ---------- ghpython_script: Python ----------
import rhinoscriptsyntax as rs
import random

domainU = rs.SurfaceDomain(surface,0)
domainV = rs.SurfaceDomain(surface,1)

pts = []

for i in range(count):
    u = random.uniform(domainU[0],domainU[1])
    v = random.uniform(domainV[0],domainV[1])    
    pt = rs.EvaluateSurface(surface,u,v)
    pts.append(pt)
    
pts_out = pts
# ---------- end ghpython_script ----------
# www.wickersonstudios.com
# gitHub: Mwickerson
wickerson_s_first_grasshopper_component = WickersonsFirstGrasshopperComponent()
# Surface Rain
number_slider_2 = Slider(36, range=0..100)
surface_2 = Surface(<surface referenced from the Rhino model>)
ghpython_script_2 = GhPythonScript(surface=surface_2, count=number_slider_2)  # -> out, pts_out; inputs surface: Surface, count: Int32; same code as ghpython_script
point = Point(ghpython_script_2.pts_out)
ghpython_script_3 = GhPythonScript(surface=surface_2, pts=ghpython_script_2.pts_out, times=Slider(100, range=0..100))  # -> out, pts_out, rail_out; inputs surface: Surface, pts: list of Point3d, times: Int32
# ---------- ghpython_script_3: Python ----------
import rhinoscriptsyntax as rs

rail = []

for i in range(len(pts)):
    dropList = []
    drop = pts[i]
    dropList.append(drop)
    
    for j in range(times):
        drop = rs.CopyObject(drop,(0,0,-i))
        ptuv = rs.SurfaceClosestPoint(surface,drop)
        drop = rs.EvaluateSurface(surface,ptuv[0],ptuv[1])
        dropList.append(drop)
        
    curve = rs.AddInterpCurve(dropList)
    rail.append(curve)
    
rail_out = rail
# ---------- end ghpython_script_3 ----------
range = Range(Domain=Domain(0, 1), Steps=10)
point_2 = Point(ghpython_script_3.pts_out)
curve = Curve(ghpython_script_3.rail_out)
graph_mapper = GraphMapper(
    range,
    x0=0,
    x1=5,
    y0=0,
    y1=5,
    container_name="Sine",
    Equation_px=[0.001704119262, 0.1872041821],
    Equation_py=[0.1773235202, 0.7911341786])
pipe_variable = PipeVariable(Curve=reparameterize(curve), Parameters=range, Radii=graph_mapper, Caps="2")
pipe = Pipe(Curve=curve, Radius=Slider(10, range=0..10), Caps="2")  # disabled
panel = Panel(pipe_variable)
geometry = Geometry(pipe_variable)
custom_preview = CustomPreview(Geometry=geometry, Material=ColourSwatch(SwatchColor=RGB(216, 100, 255)))
custom_preview_2 = CustomPreview(Geometry=surface_2, Material=ColourSwatch(SwatchColor=RGB(246, 255, 0)))
