# Grasshopper definition 0.2_Rhino_Grasshopper_Python_WickersonStudios_Geometry_Rationalize_2.0_Revit2021_022.gh (Grasshopper 1.0.7)
# Copyright: bernhard muller bijoutiers
# plug-ins: Workshop

# www.wickersonstudios.com
# gitHub: Mwickerson
wickerson_s_first_grasshopper_component = WickersonsFirstGrasshopperComponent()
number_slider = Slider(4, range=0..30)  # disabled

number_slider_2 = Slider(4, range=0..30)  # disabled
number_slider_3 = Slider(0, range=0..10)  # disabled
number_slider_4 = Slider(7.215, range=0..10)  # disabled
surface = Surface(<surface referenced from the Rhino model>)  # disabled
number_slider_5 = Slider(2, range=0..10)  # disabled
ghpython_script = GhPythonScript(
    surface=surface,
    uDiv=number_slider_2,
    vDiv=number_slider_2,
    Step=number_slider_3,
    threshold=number_slider_4,
    level=number_slider_5)  # -> out, samplePanel_out, optPanelList_out; inputs surface: Surface, uDiv: Int32, vDiv: Int32, Step: Int32, level: Int32; disabled
# ---------- ghpython_script: Python ----------
import rhinoscriptsyntax as rs

sample = []

domainU = rs.SurfaceDomain(surface,0)
domainV = rs.SurfaceDomain(surface,1)
du = (domainU[1]-domainV[0])/uDiv    
dv = (domainV[1]-domainV[0])/vDiv

for i in range(0,uDiv,1):
    for j in range(0,vDiv,1):
        uValA = du*(i+Step)
        uValB = du*(i+Step+1)
        vValA = dv*(j+Step)
        vValB = dv*(j+Step+1)
        sample.append([[uValA,vValA],[uValA,vValB],[uValB,vValB],[uValB,vValA]])

samplePanel = []

for pts in sample:
    ptsForPanel = []
    for pt in pts:
        ptsForPanel.append(rs.EvaluateSurface(surface,pt[0],pt[1]))
    panel = rs.AddSrfPt(ptsForPanel)
    samplePanel.append(panel)
    
def SrfSubD(pts):
    pt5 = [(pts[0][0]+pts[1][0])/2,(pts[0][1]+pts[1][1])/2]
    pt6 = [(pts[1][0]+pts[2][0])/2,(pts[1][1]+pts[2][1])/2]
    pt7 = [(pts[2][0]+pts[3][0])/2,(pts[2][1]+pts[3][1])/2]
    pt8 = [(pts[3][0]+pts[0][0])/2,(pts[3][1]+pts[0][1])/2]
    pt9 = [(pts[0][0]+pts[2][0])/2,(pts[0][1]+pts[2][1])/2]
    
    panelA = [pts[0],pt5,pt9,pt8]
    panelB = [pt5,pts[1],pt6,pt9]
    panelC = [pt9,pt6,pts[2],pt7]
    panelD = [pt8,pt9,pt7,pts[3]]
    panels = [panelA,panelB,panelC,panelD]
    
    return panels
    
def SurfacePaneling(srf,panelList,threshold):
    subDPanelList = panelList[:]
    
    for i in range(len(panelList)):
        panel = panelList[i]
        maxAngle = threshold
        midPtVal = [(panel[0][0]+panel[2][0])/2,(panel[0][1]+panel[2][1])/2]
        midPt = rs.EvaluateSurface(srf,midPtVal[0],midPtVal[1])
        normal = rs.SurfaceNormal(srf,midPtVal)
        
        for ptVal in panel:
            pt = rs.EvaluateSurface(srf,ptVal[0],ptVal[1])
            vec = rs.VectorCreate(pt,midPt)
            tempAngle = abs(rs.VectorAngle(normal,vec))
            angle = abs(tempAngle-90)
            
            if (angle > maxAngle):
                maxAngle = angle
        
        if (maxAngle > threshold):
            subDpanels = SrfSubD(panel)
            subDPanelList.extend(subDpanels)
            subDPanelList.remove(panel)
    
    return subDPanelList

optPanelList = []

for i in range(level):
    subDPanel = SurfacePaneling(surface,sample,threshold)
    sample = subDPanel

for pts in sample:
    ptsForPanel = []
    for pt in pts:
        ptsForPanel.append(rs.EvaluateSurface(surface,pt[0],pt[1]))
    optPanel = rs.AddSrfPt(ptsForPanel)
    optPanelList.append(optPanel)

samplePanel_out = samplePanel
optPanelList_out = optPanelList
# ---------- end ghpython_script ----------
geometry = Geometry(ghpython_script.optPanelList_out)  # disabled
geometry_2 = Geometry(ghpython_script.samplePanel_out)  # disabled

number_slider_6 = Slider(0, range=0..10)  # disabled

# ----
# best with even numbers
number_slider_7 = Slider(5, range=0..30)  # disabled
number_slider_8 = Slider(0, range=0..2)  # disabled
number_slider_9 = Slider(10, range=0..10)  # disabled
surface_2 = Surface(<surface referenced from the Rhino model>)  # disabled
number_slider_10 = Slider(2, range=0..3)  # disabled
number_slider_11 = Slider(2, range=0..3)  # disabled
number_slider_12 = Slider(1, range=0..3)  # disabled
number_slider_13 = Slider(0, range=0..3)  # disabled
number_slider_14 = Slider(1, range=0..5)  # disabled
ghpython_script_2 = GhPythonScript(
    surface=surface_2,
    uDiv=number_slider_7,
    vDiv=number_slider_7,
    Step=number_slider_8,
    threshold=number_slider_9,
    level=number_slider_14,
    funkX=number_slider_11,
    funkY=number_slider_12,
    funkZ=number_slider_13,
    funkU=number_slider_10)  # -> out, samplePanel_out, optPanelList_out; inputs surface: Surface, uDiv: Int32, vDiv: Int32, Step: Int32, level: Int32, funkX: Int32, funkY: Int32, funkZ: Int32, funkU: Int32; disabled
# ---------- ghpython_script_2: Python ----------
import rhinoscriptsyntax as rs

sample = []

domainU = rs.SurfaceDomain(surface,0)
domainV = rs.SurfaceDomain(surface,1)
du = (domainU[1]-domainV[0])/uDiv    
dv = (domainV[1]-domainV[0])/vDiv

for i in range(0,uDiv,1):
    for j in range(0,vDiv,1):
        uValA = du*(i+Step)
        uValB = du*(i+Step+1)
        vValA = dv*(j+Step)
        vValB = dv*(j+Step+1)
        sample.append([[uValA,vValA],[uValA,vValB],[uValB,vValB],[uValB,vValA]])

samplePanel = []

for pts in sample:
    ptsForPanel = []
    for pt in pts:
        ptsForPanel.append(rs.EvaluateSurface(surface,pt[0],pt[1]))
    panel = rs.AddSrfPt(ptsForPanel)
    samplePanel.append(panel)
    
def SrfSubD(pts):
    pt5 = [(pts[0][0]+pts[funkX][0])/2,(pts[0][1]+pts[1][1])/2]
    pt6 = [(pts[1][0]+pts[funkY][0])/2,(pts[1][1]+pts[2][1])/2]
    pt7 = [(pts[2][0]+pts[funkZ][0])/2,(pts[2][1]+pts[3][1])/2]
    pt8 = [(pts[3][0]+pts[funkU][0])/2,(pts[3][1]+pts[0][1])/2]
    pt9 = [(pts[0][0]+pts[funkX][0])/2,(pts[0][1]+pts[2][1])/2] #pts[1]
    
    panelA = [pts[0],pt5,pt9,pt8]
    panelB = [pt5,pts[1],pt6,pt9]
    panelC = [pt9,pt6,pts[2],pt7]
    panelD = [pt8,pt9,pt7,pts[3]]
    panels = [panelA,panelB,panelC,panelD]
    
    return panels
    
def SurfacePaneling(srf,panelList,threshold):
    subDPanelList = panelList[:]
    
    for i in range(len(panelList)):
        panel = panelList[i]
        maxAngle = threshold
        midPtVal = [(panel[0][0]+panel[2][0])/2,(panel[0][1]+panel[2][1])/2]
        midPt = rs.EvaluateSurface(srf,midPtVal[0],midPtVal[1])
        normal = rs.SurfaceNormal(srf,midPtVal)
        
        for ptVal in panel:
            pt = rs.EvaluateSurface(srf,ptVal[0],ptVal[1])
            vec = rs.VectorCreate(pt,midPt)
            tempAngle = abs(rs.VectorAngle(normal,vec))
            angle = abs(tempAngle-90)
            
            if (angle > maxAngle):
                maxAngle = angle
        
        if (maxAngle > threshold):
            subDpanels = SrfSubD(panel)
            subDPanelList.extend(subDpanels)
            subDPanelList.remove(panel)
    
    return subDPanelList

optPanelList = []

for i in range(level):
    subDPanel = SurfacePaneling(surface,sample,threshold)
    sample = subDPanel

for pts in sample:
    ptsForPanel = []
    for pt in pts:
        ptsForPanel.append(rs.EvaluateSurface(surface,pt[0],pt[1]))
    optPanel = rs.AddSrfPt(ptsForPanel)
    optPanelList.append(optPanel)

samplePanel_out = samplePanel
optPanelList_out = optPanelList
# ---------- end ghpython_script_2 ----------
geometry_3 = Geometry(ghpython_script_2.samplePanel_out)  # disabled
geometry_4 = Geometry(ghpython_script_2.optPanelList_out)  # disabled

number_slider_15 = Slider(0, range=0..10)  # disabled
number_slider_16 = Slider(4, range=0..30)  # disabled
# Surface Rationalization with Quads
surface_3 = Surface(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)  # disabled
number_slider_17 = Slider(0.571, range=0..10)  # disabled
number_slider_18 = Slider(0, range=0..10)  # disabled
number_slider_19 = Slider(10, range=0..30)  # disabled
surface_4 = Surface(<surface referenced from the Rhino model>)  # disabled
surface_5 = Surface(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)  # disabled
ghpython_script_3 = GhPythonScript(surface=surface_4, uDiv=number_slider, vDiv=number_slider, Step=number_slider_6, threshold=number_slider_17)  # -> out, samplePanel_out; inputs surface: Surface, uDiv: Int32, vDiv: Int32, Step: Int32; disabled
# ---------- ghpython_script_3: Python ----------
import rhinoscriptsyntax as rs

sample = []

domainU = rs.SurfaceDomain(surface,0)
domainV = rs.SurfaceDomain(surface,1)
du = (domainU[1]-domainV[0])/uDiv    
dv = (domainV[1]-domainV[0])/vDiv

for i in range(0,uDiv,1):
    for j in range(0,vDiv,1):
        uValA = du*(i+Step)
        uValB = du*(i+Step+1)
        vValA = dv*(j+Step)
        vValB = dv*(j+Step+1)
        sample.append([[uValA,vValA],[uValA,vValB],[uValB,vValB],[uValB,vValA]])
        
samplePanel = []

for pts in sample:
    ptsForPanel = []
    for pt in pts:
        ptsForPanel.append(rs.EvaluateSurface(surface,pt[0],pt[1]))
    panel = rs.AddSrfPt(ptsForPanel)
    samplePanel.append(panel)
    
def SrfSubD(pts):
    pt5 = [(pts[0][0]+pts[1][0])/2,(pts[0][1]+pts[1][1])/2]
    pt6 = [(pts[1][0]+pts[2][0])/2,(pts[1][1]+pts[2][1])/2]
    pt7 = [(pts[2][0]+pts[3][0])/2,(pts[2][1]+pts[3][1])/2]
    pt8 = [(pts[3][0]+pts[0][0])/2,(pts[3][1]+pts[0][1])/2]
    pt9 = [(pts[0][0]+pts[1][0])/2,(pts[0][1]+pts[2][1])/2]
    
    panelA = [pts[0],pt5,pt9,pt8]
    panelB = [pt5,pts[1],pt6,pt9]
    panelC = [pt9,pt6,pts[2],pt7]
    panelD = [pt8,pt9,pt7,pts[3]]
    panels = [panelA,panelB,panelC,panelD]
    
    return panels
    
def SurfacePaneling(srf,panelList,threshold):
    subDPanelList = panelList[:]
    
    for i in range(len(panelList)):
        panel = panelList[i]
        maxAngle = threshold
        midPtVal = [(panel[0][0]+panel[2][0])/2,(panel[0][1]+panel[2][1])/2]
        midPt = rs.EvaluateSurface(srf,midPtVal[0],midPtVal[1])
        normal = rs.SurfaceNormal(srf,midPtVal)
        
        for ptVal in panel:
            pt = rs.EvaluateSurface(srf,ptVal[0],ptVal[1])
            vec = rs.VectorCreate(pt,midPt)
            tempAngle = abs(rs.VectorAngle(normal,vec))
            angle = abs(tempAngle-90)
            
            if (angle > maxAngle):
                maxAngle = angle
        
        if (maxAngle > threshold):
            subDpanels = SrfSubD(panel)
            subDPanelList.extend(subDpanels)
            subDPanelList.remove(panel)
    
    return subDPanelList

samplePanel_out = samplePanel
# ---------- end ghpython_script_3 ----------
ghpython_script_4 = GhPythonScript(surface=surface_5, uDiv=number_slider_16, vDiv=number_slider_16, Step=number_slider_15)  # -> out, samplePanel_out; inputs surface: Surface, uDiv: Int32, vDiv: Int32, Step: Int32; disabled
# ---------- ghpython_script_4: Python ----------
import rhinoscriptsyntax as rs

sample = []

domainU = rs.SurfaceDomain(surface,0)
domainV = rs.SurfaceDomain(surface,1)
du = (domainU[1]-domainV[0])/uDiv    
dv = (domainV[1]-domainV[0])/vDiv

for i in range(0,uDiv,1):
    for j in range(0,vDiv,1):
        uValA = du*(i+Step)
        uValB = du*(i+Step+1)
        vValA = dv*(j+Step)
        vValB = dv*(j+Step+1)
        sample.append([[uValA,vValA],[uValA,vValB],[uValB,vValB],[uValB,vValA]])
        
samplePanel = []

for pts in sample:
    ptsForPanel = []
    for pt in pts:
        ptsForPanel.append(rs.EvaluateSurface(surface,pt[0],pt[1]))
    panel = rs.AddSrfPt(ptsForPanel)
    samplePanel.append(panel)
    
def SrfSubD(pts):
    pt5 = [(pts[0][0]+pts[1][0])/2,(pts[0][1]+pts[1][1])/2]
    pt6 = [(pts[1][0]+pts[2][0])/2,(pts[1][1]+pts[2][1])/2]
    pt7 = [(pts[2][0]+pts[3][0])/2,(pts[2][1]+pts[3][1])/2]
    pt8 = [(pts[3][0]+pts[0][0])/2,(pts[3][1]+pts[0][1])/2]
    pt9 = [(pts[0][0]+pts[1][0])/2,(pts[0][1]+pts[2][1])/2]
    
    panelA = [pts[0],pt5,pt9,pt8]
    panelB = [pt5,pts[1],pt6,pt9]
    panelC = [pt9,pt6,pts[2],pt7]
    panelD = [pt8,pt9,pt7,pts[3]]
    panels = [panelA,panelB,panelC,panelD]
    
    return panels
    
samplePanel_out = samplePanel
# ---------- end ghpython_script_4 ----------
ghpython_script_5 = GhPythonScript(surface=surface_3, uDiv=number_slider_19, vDiv=number_slider_19, Step=number_slider_18)  # -> out, samplePanel_out; inputs surface: Surface, uDiv: Int32, vDiv: Int32, Step: Int32; disabled
# ---------- ghpython_script_5: Python ----------
import rhinoscriptsyntax as rs

sample = []

domainU = rs.SurfaceDomain(surface,0)
domainV = rs.SurfaceDomain(surface,1)
du = (domainU[1]-domainV[0])/uDiv    
dv = (domainV[1]-domainV[0])/vDiv

for i in range(0,uDiv,1):
    for j in range(0,vDiv,1):
        uValA = du*(i+Step)
        uValB = du*(i+Step+1)
        vValA = dv*(j+Step)
        vValB = dv*(j+Step+1)
        sample.append([[uValA,vValA],[uValA,vValB],[uValB,vValB],[uValB,vValA]])
        
samplePanel = []

for pts in sample:
    ptsForPanel = []
    for pt in pts:
        ptsForPanel.append(rs.EvaluateSurface(surface,pt[0],pt[1]))
    panel = rs.AddSrfPt(ptsForPanel)
    samplePanel.append(panel)
    
samplePanel_out = samplePanel
# ---------- end ghpython_script_5 ----------
geometry_5 = Geometry(ghpython_script_5.samplePanel_out)  # disabled
geometry_6 = Geometry(ghpython_script_3.samplePanel_out)  # disabled
geometry_7 = Geometry(ghpython_script_4.samplePanel_out)  # disabled
colour_swatch = ColourSwatch(SwatchColor=RGB(241, 140, 93))  # disabled

# ----
# Internalized Surface xy Plane
surface_6 = Surface(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)  # disabled
deconstruct_brep = DeconstructBrep(Brep=geometry_4)  # -> Faces, Edges, Vertices; disabled
unit_z = UnitZ(Factor=1)  # disabled
negative = Negative(Value=unit_z)  # disabled
project = Project(Curve=deconstruct_brep.Edges, Brep=surface_6, Direction=negative)  # -> simplify(Curve); disabled
curve = Curve(simplify(graft(deconstruct_brep.Edges)))  # disabled
loft = Loft(Curves=[curve, project], Options={Adjust=True, Closed=False, LoftEnds=0, LoftSimp=0, LoftType=0, Rebuild=10, Refit=0.01})  # disabled
colour_swatch_2 = ColourSwatch(SwatchColor=RGB(0, 255, 255))  # disabled
geometry_8 = Geometry(geometry_4)  # disabled
custom_preview = CustomPreview(Geometry=geometry_8, Material=colour_swatch)  # disabled
custom_preview_2 = CustomPreview(Geometry=loft, Material=colour_swatch_2)  # disabled
