# Grasshopper definition 0.2_Rhino_Grasshopper_Python_WickersonStudios_Geometry_Rationalize_Revit2021_021.gh (Grasshopper 1.0.7)
# Copyright: bernhard muller bijoutiers
# plug-ins: Workshop

# www.wickersonstudios.com
# gitHub: Mwickerson
wickerson_s_first_grasshopper_component = WickersonsFirstGrasshopperComponent()  # disabled
number_slider = Slider(10, range=0..30)  # disabled
number_slider_2 = Slider(0, range=0..10)  # disabled

# ----
# Surface Rationalization and Color  Visualization
number_slider_3 = Slider(14, range=0..30)
surface = Surface(<surface referenced from the Rhino model>)
ghpython_script = GhPythonScript(
    surface=surface,
    uDiv=number_slider_3,
    vDiv=number_slider_3,
    Step=Slider(1, range=0..10),
    tolerance=Slider(1.32, range=0..10),
    uSTEP=Slider(1, range=1..4),
    vSTEP=Slider(1, range=1..4))  # -> out, Panel_out, distList_out, optPanels_out; inputs surface: Surface, uDiv: Int32, vDiv: Int32, Step: Int32, uSTEP: Int32, vSTEP: Int32
# ---------- ghpython_script: Python ----------
import rhinoscriptsyntax as rs

panels = []
distList = []
optPanels = []

domainU = rs.SurfaceDomain(surface,0)
domainV = rs.SurfaceDomain(surface,1)
du = (domainU[1]-domainV[0])/uDiv    
dv = (domainV[1]-domainV[0])/vDiv

for i in range(0,uDiv,uSTEP):
    for j in range(0,vDiv,vSTEP):
        ptA = rs.EvaluateSurface(surface,du*(i+Step),dv*(j+Step))
        ptB = rs.EvaluateSurface(surface,du*(i+Step+1),dv*(j+Step))
        ptC = rs.EvaluateSurface(surface,du*(i+Step+1),dv*(j+Step+1))
        ptD = rs.EvaluateSurface(surface,du*(i+Step),dv*(j+Step+1))
        
        panel = rs.AddSrfPt([ptA,ptB,ptC,ptD])
        panels.append(panel)
        plane = rs.PlaneFromPoints(ptA,ptB,ptC)
        dist = abs(rs.DistanceToPlane(plane,ptD))
        distList.append(dist)
        
        #conditionals
        if (dist < tolerance):
            panel = rs.AddSrfPt([ptA,ptB,ptC,ptD])
            optPanels.append(panel)
            
        else:
            panelA = rs.AddSrfPt([ptA,ptB,ptC])
            panelB = rs.AddSrfPt([ptA,ptB,ptD])
            optPanels.append(panelA)
            optPanels.append(panelB)
            
Panel_out = panels
distList_out = distList
optPanels_out = optPanels
# ---------- end ghpython_script ----------
panel = Panel(ghpython_script.distList_out)
dispatch = Dispatch(List=flatten(ghpython_script.Panel_out), DispatchPattern=[True, False])  # -> ListA, ListB
bounds = Bounds(Numbers=ghpython_script.distList_out)
deconstruct_domain = DeconstructDomain(Domain=bounds)  # -> Start, End
gradient = Gradient(
    LowerLimit=deconstruct_domain.Start,
    UpperLimit=deconstruct_domain.End,
    Parameter=ghpython_script.distList_out,
    stops=[0: RGB(0, 98, 0), 0.25: RGB(81, 175, 17), 0.5: RGB(159, 198, 146), 0.75: RGB(170, 235, 41), 1: RGB(221, 255, 53)])
gradient_2 = Gradient(
    LowerLimit=deconstruct_domain.Start,
    UpperLimit=deconstruct_domain.End,
    Parameter=ghpython_script.distList_out,
    stops=[0.15: RGB(255, 130, 160), 0.85: RGB(220, 0, 40)])
custom_preview = CustomPreview(Geometry=dispatch.ListA, Material=gradient_2)
custom_preview_2 = CustomPreview(Geometry=dispatch.ListB, Material=gradient)

# ----
# Surface Rationalization and Color  Visualization
surface_2 = Surface(<surface referenced from the Rhino model>)  # disabled
relative_item = RelativeItem(WrapPaths=False, WrapItems=False)  # -> ItemA, ItemB
ghpython_script_2 = GhPythonScript(surface=surface_2, uDiv=number_slider, vDiv=number_slider, Step=number_slider_2)  # -> out, Panel_out, distList_out; inputs surface: Surface, uDiv: Int32, vDiv: Int32, Step: Int32; disabled
# ---------- ghpython_script_2: Python ----------
import rhinoscriptsyntax as rs

panels = []
distList = []

domainU = rs.SurfaceDomain(surface,0)
domainV = rs.SurfaceDomain(surface,1)
du = (domainU[1]-domainV[0])/uDiv    
dv = (domainV[1]-domainV[0])/vDiv

for i in range(0,uDiv,1):
    for j in range(0,vDiv,1):
        ptA = rs.EvaluateSurface(surface,du*(i+Step),dv*(j+Step))
        ptB = rs.EvaluateSurface(surface,du*(i+Step+1),dv*(j+Step))
        ptC = rs.EvaluateSurface(surface,du*(i+Step+1),dv*(j+Step+1))
        ptD = rs.EvaluateSurface(surface,du*(i+Step),dv*(j+Step+1))
        
        panel = rs.AddSrfPt([ptA,ptB,ptC,ptD])
        panels.append(panel)
        plane = rs.PlaneFromPoints(ptA,ptB,ptC)
        dist = abs(rs.DistanceToPlane(plane,ptD))
        distList.append(dist)

Panel_out = panels
distList_out = distList
# ---------- end ghpython_script_2 ----------
panel_2 = Panel(ghpython_script_2.distList_out)  # disabled
dispatch_2 = Dispatch(List=flatten(ghpython_script_2.Panel_out), DispatchPattern=[True, False])  # -> ListA, ListB; disabled
bounds_2 = Bounds(Numbers=ghpython_script_2.distList_out)  # disabled

surface_3 = Surface(ghpython_script.optPanels_out)
gradient_3 = Gradient(
    LowerLimit=deconstruct_domain.Start,
    UpperLimit=deconstruct_domain.End,
    Parameter=ghpython_script.distList_out,
    stops=[0.19: RGB(173, 203, 249), 1: RGB(75, 107, 169)])
custom_preview_3 = CustomPreview(Geometry=surface_3, Material=gradient_3)

deconstruct_domain_2 = DeconstructDomain(Domain=bounds_2)  # -> Start, End; disabled
gradient_4 = Gradient(
    LowerLimit=deconstruct_domain_2.Start,
    UpperLimit=deconstruct_domain_2.End,
    Parameter=ghpython_script_2.distList_out,
    stops=[0.15: RGB(255, 130, 160), 0.85: RGB(220, 0, 40)])  # disabled
gradient_5 = Gradient(
    LowerLimit=deconstruct_domain_2.Start,
    UpperLimit=deconstruct_domain_2.End,
    Parameter=ghpython_script_2.distList_out,
    stops=[0: RGB(0, 98, 0), 0.25: RGB(81, 175, 17), 0.5: RGB(159, 198, 146), 0.75: RGB(170, 235, 41), 1: RGB(221, 255, 53)])  # disabled

dispatch_3 = Dispatch(List=flatten(dispatch_2.ListA), DispatchPattern=[True, False])  # -> ListA, ListB; disabled
dispatch_4 = Dispatch(List=flatten(dispatch_2.ListB), DispatchPattern=[True, False])  # -> ListA, ListB; disabled
surface_4 = Surface(dispatch_3.ListA)  # disabled
surface_5 = Surface(dispatch_4.ListA)  # disabled
surface_6 = Surface(dispatch_4.ListB)  # disabled
surface_7 = Surface(dispatch_3.ListB)  # disabled

dispatch_5 = Dispatch(List=flatten(dispatch.ListA), DispatchPattern=[True, False])  # -> ListA, ListB
dispatch_6 = Dispatch(List=flatten(dispatch.ListB), DispatchPattern=[True, False])  # -> ListA, ListB
surface_8 = Surface(dispatch_5.ListA)
surface_9 = Surface(dispatch_5.ListB)
surface_10 = Surface(dispatch_6.ListA)
surface_11 = Surface(dispatch_6.ListB)

custom_preview_4 = CustomPreview(Geometry=dispatch_2.ListB, Material=gradient_5)  # disabled
custom_preview_5 = CustomPreview(Geometry=dispatch_2.ListA, Material=gradient_4)  # disabled
