# Grasshopper definition 0.2_Rhino_Grasshopper_Python_WickersonStudios_Geometry_Shell_Revit2021_019.gh (Grasshopper 1.0.7)
# Copyright: bernhard muller bijoutiers
# plug-ins: Workshop

# www.wickersonstudios.com
# www.michaelwickerson.com
# 
# youtube: Michael Wickerson
# gitHub: Mwickerson
# instagram: WickersonStudiosAR
wickerson_s_first_grasshopper_component = WickersonsFirstGrasshopperComponent()  # disabled

# ----
# Surface Division by Triangles
surface = Surface(<surface referenced from the Rhino model>)
number_slider = Slider(3, range=0..6)
negative = Negative(Value=number_slider)
ghpython_script = GhPythonScript(surface=surface, uDiv=Slider(10, range=0..10), vDiv=Slider(10, range=0..10), Step=[number_slider, negative])  # -> out, TriPanel_out; inputs surface: Surface, uDiv: Int32, vDiv: Int32, Step: Int32
# ---------- ghpython_script: Python ----------
import rhinoscriptsyntax as rs

def TriPanel(surf):
    domainU = rs.SurfaceDomain(surf,0)
    domainV = rs.SurfaceDomain(surf,1)
    du = (domainU[1]-domainV[0])/uDiv    
    dv = (domainV[1]-domainV[0])/vDiv
    
    panels = []
    
    for i in range(uDiv):
        for j in range(vDiv):
            ptA = rs.EvaluateSurface(surf,du*(i+Step),dv*(j+Step))
            ptB = rs.EvaluateSurface(surf,du*(i+Step+1),dv*(j+Step))
            ptC = rs.EvaluateSurface(surf,du*(i+Step+1),dv*(j+Step+1))
            ptD = rs.EvaluateSurface(surf,du*(i+Step),dv*(j+Step+1))
            
            panelA = rs.AddSrfPt([ptA,ptB,ptC])
            panelB = rs.AddSrfPt([ptA,ptC,ptD])
            panels.append(panelA)
            panels.append(panelB)
    
    return panels

TriPanel_out = TriPanel(surface)
# ---------- end ghpython_script ----------
dispatch = Dispatch(List=flatten(ghpython_script.TriPanel_out), DispatchPattern=[True, False])  # -> ListA, ListB
dispatch_2 = Dispatch(List=flatten(dispatch.ListA), DispatchPattern=[True, False])  # -> ListA, ListB
dispatch_3 = Dispatch(List=flatten(dispatch.ListB), DispatchPattern=[True, False])  # -> ListA, ListB
surface_2 = Surface(dispatch_2.ListA)
surface_3 = Surface(dispatch_2.ListB)
surface_4 = Surface(dispatch_3.ListA)
surface_5 = Surface(dispatch_3.ListB)

# ----
# Surface Division
surface_6 = Surface(<surface referenced from the Rhino model>)  # disabled
number_slider_2 = Slider(6, range=0..10)  # disabled
number_slider_3 = Slider(7, range=0..10)  # disabled
number_slider_4 = Slider(2, range=0..6)  # disabled
negative_2 = Negative(Value=number_slider_4)  # disabled
ghpython_script_2 = GhPythonScript(surface=surface_6, uDiv=number_slider_2, vDiv=number_slider_3, Step=[number_slider_4, negative_2])  # -> out, QuadPanel_out; inputs surface: Surface, uDiv: Int32, vDiv: Int32, Step: Int32; disabled
# ---------- ghpython_script_2: Python ----------
import rhinoscriptsyntax as rs

def QuadPanel(surf):
    domainU = rs.SurfaceDomain(surf,0)
    domainV = rs.SurfaceDomain(surf,1)
    du = (domainU[1]-domainV[0])/uDiv    
    dv = (domainV[1]-domainV[0])/vDiv
    
    panels = []
    
    for i in range(uDiv):
        for j in range(vDiv):
            ptA = rs.EvaluateSurface(surf,du*(i+Step),dv*(j+Step))
            ptB = rs.EvaluateSurface(surf,du*(i+Step+1),dv*(j+Step))
            ptC = rs.EvaluateSurface(surf,du*(i+Step+1),dv*(j+Step+1))
            ptD = rs.EvaluateSurface(surf,du*(i+Step),dv*(j+Step+1))
            
            panel = rs.AddSrfPt([ptA,ptB,ptC,ptD])
            panels.append(panel)
    
    return panels

QuadPanel_out = QuadPanel(surface)
# ---------- end ghpython_script_2 ----------

dispatch_4 = Dispatch(List=flatten(ghpython_script_2.QuadPanel_out), DispatchPattern=[True, False])  # -> ListA, ListB; disabled
dispatch_5 = Dispatch(List=flatten(dispatch_4.ListB), DispatchPattern=[True, False])  # -> ListA, ListB; disabled
dispatch_6 = Dispatch(List=flatten(dispatch_4.ListA), DispatchPattern=[True, False])  # -> ListA, ListB; disabled
surface_7 = Surface(dispatch_6.ListB)  # disabled
surface_8 = Surface(dispatch_5.ListB)  # disabled
surface_9 = Surface(dispatch_5.ListA)  # disabled

surface_10 = Surface(dispatch_6.ListA)  # disabled
