# Grasshopper definition 0.2_Rhino_Grasshopper_Python_WickersonStudios_Geometry_Shell_Revit2021_020.gh (Grasshopper 1.0.7)
# Copyright: bernhard muller bijoutiers
# plug-ins: Workshop

# www.wickersonstudios.com
# gitHub: Mwickerson
wickerson_s_first_grasshopper_component = WickersonsFirstGrasshopperComponent()

# ----
# Surface Division by Triangles
number_slider = Slider(2, range=0..10)
number_slider_2 = Slider(10, range=0..10)
surface = Surface(<surface referenced from the Rhino model>)
division = Division(A=number_slider_2, B="2")
negative = Negative(Value=division)
ghpython_script = GhPythonScript(surface=surface, uDiv=number_slider_2, vDiv=number_slider_2, Step=[division, negative])  # -> out, TriPanel_out; inputs surface: Surface, uDiv: Int32, vDiv: Int32, Step: Int32
# ---------- ghpython_script: Python ----------
import rhinoscriptsyntax as rs

def TriPanel(surf):
    domainU = rs.SurfaceDomain(surf,0)
    domainV = rs.SurfaceDomain(surf,1)
    du = (domainU[1]-domainV[0])/uDiv    
    dv = (domainV[1]-domainV[0])/vDiv
    
    panels = []
    
    for i in range(uDiv):
        for j in range(vDiv):
            ptA = rs.EvaluateSurface(surf,du*(i+Step),dv*(j+Step))
            ptB = rs.EvaluateSurface(surf,du*(i+Step+1),dv*(j+Step))
            ptC = rs.EvaluateSurface(surf,du*(i+Step+1),dv*(j+Step+1))
            ptD = rs.EvaluateSurface(surf,du*(i+Step),dv*(j+Step+1))
            
            panelA = rs.AddSrfPt([ptA,ptB,ptC])
            panelB = rs.AddSrfPt([ptA,ptC,ptD])
            panels.append(panelA)
            panels.append(panelB)
    
    return panels

TriPanel_out = TriPanel(surface)
# ---------- end ghpython_script ----------
dispatch = Dispatch(List=flatten(ghpython_script.TriPanel_out), DispatchPattern=[True, False])  # -> ListA, ListB
dispatch_2 = Dispatch(List=flatten(dispatch.ListB), DispatchPattern=[True, False])  # -> ListA, ListB
dispatch_3 = Dispatch(List=flatten(dispatch.ListA), DispatchPattern=[True, False])  # -> ListA, ListB
surface_2 = Surface(dispatch_3.ListA)
surface_3 = Surface(dispatch_3.ListB)
surface_4 = Surface(dispatch_2.ListA)
surface_5 = Surface(dispatch_2.ListB)

# ----
# Surface Division by Diamond Sections
number_slider_3 = Slider(8, range=0..10)
number_slider_4 = Slider(30, range=0..30)
surface_6 = Surface(<surface referenced from the Rhino model>)
panel = Panel("2")
division_2 = Division(A=number_slider_4, B=number_slider_3)
negative_2 = Negative(Value=division_2)
ghpython_script_2 = GhPythonScript(surface=surface_6, uDiv=number_slider_4, vDiv=number_slider_4, Step=[division_2, negative_2])  # -> out, DiaPanel_out; inputs surface: Surface, uDiv: Int32, vDiv: Int32, Step: Int32
# ---------- ghpython_script_2: Python ----------
import rhinoscriptsyntax as rs

def DiaPanel(surf):
    domainU = rs.SurfaceDomain(surf,0)
    domainV = rs.SurfaceDomain(surf,1)
    du = (domainU[1]-domainV[0])/uDiv    
    dv = (domainV[1]-domainV[0])/vDiv
    
    panels = []
    
    for i in range(0,uDiv,2):
        for j in range(0,vDiv,2):
            ptA = rs.EvaluateSurface(surf,du*(i+Step+1),dv*(j+Step))
            ptB = rs.EvaluateSurface(surf,du*(i+Step+2),dv*(j+Step+1))
            ptC = rs.EvaluateSurface(surf,du*(i+Step+1),dv*(j+Step+2))
            ptD = rs.EvaluateSurface(surf,du*(i+Step),dv*(j+Step+1))
            
            panelA = rs.AddSrfPt([ptA,ptB,ptC,ptD])
            panels.append(panelA)

    for i in range(0,uDiv-2,2):
        for j in range(0,vDiv-2,2):
            ptA = rs.EvaluateSurface(surf,du*(i+Step+2),dv*(j+Step+2))
            ptB = rs.EvaluateSurface(surf,du*(i+Step+3),dv*(j+Step+2))
            ptC = rs.EvaluateSurface(surf,du*(i+Step+2),dv*(j+Step+3))
            ptD = rs.EvaluateSurface(surf,du*(i+Step+1),dv*(j+Step+2))
            
            panelB = rs.AddSrfPt([ptA,ptB,ptC,ptD])
            panels.append(panelB)
    
    return panels

DiaPanel_out = DiaPanel(surface)
# ---------- end ghpython_script_2 ----------
dispatch_4 = Dispatch(List=flatten(ghpython_script_2.DiaPanel_out), DispatchPattern=[True, False])  # -> ListA, ListB
dispatch_5 = Dispatch(List=flatten(dispatch_4.ListB), DispatchPattern=[True, False])  # -> ListA, ListB
dispatch_6 = Dispatch(List=flatten(dispatch_4.ListA), DispatchPattern=[True, False])  # -> ListA, ListB
surface_7 = Surface(dispatch_6.ListA)
surface_8 = Surface(dispatch_6.ListB)
surface_9 = Surface(dispatch_5.ListA)
surface_10 = Surface(dispatch_5.ListB)

# ----
# Surface Division
number_slider_5 = Slider(6, range=0..10)
surface_11 = Surface(<surface referenced from the Rhino model>)
number_slider_6 = Slider(3, range=0..6)
negative_3 = Negative(Value=number_slider_6)
ghpython_script_3 = GhPythonScript(surface=surface_11, uDiv=Slider(8, range=0..10), vDiv=number_slider_5, Step=[number_slider_6, negative_3])  # -> out, QuadPanel_out; inputs surface: Surface, uDiv: Int32, vDiv: Int32, Step: Int32
# ---------- ghpython_script_3: Python ----------
import rhinoscriptsyntax as rs

def QuadPanel(surf):
    domainU = rs.SurfaceDomain(surf,0)
    domainV = rs.SurfaceDomain(surf,1)
    du = (domainU[1]-domainV[0])/uDiv    
    dv = (domainV[1]-domainV[0])/vDiv
    
    panels = []
    
    for i in range(uDiv):
        for j in range(vDiv):
            ptA = rs.EvaluateSurface(surf,du*(i+Step),dv*(j+Step))
            ptB = rs.EvaluateSurface(surf,du*(i+Step+1),dv*(j+Step))
            ptC = rs.EvaluateSurface(surf,du*(i+Step+1),dv*(j+Step+1))
            ptD = rs.EvaluateSurface(surf,du*(i+Step),dv*(j+Step+1))
            
            panel = rs.AddSrfPt([ptA,ptB,ptC,ptD])
            panels.append(panel)
    
    return panels

QuadPanel_out = QuadPanel(surface)
# ---------- end ghpython_script_3 ----------
dispatch_7 = Dispatch(List=flatten(ghpython_script_3.QuadPanel_out), DispatchPattern=[True, False])  # -> ListA, ListB
dispatch_8 = Dispatch(List=flatten(dispatch_7.ListB), DispatchPattern=[True, False])  # -> ListA, ListB
dispatch_9 = Dispatch(List=flatten(dispatch_7.ListA), DispatchPattern=[True, False])  # -> ListA, ListB
surface_12 = Surface(dispatch_9.ListB)
surface_13 = Surface(dispatch_8.ListB)
surface_14 = Surface(dispatch_8.ListA)
surface_15 = Surface(dispatch_9.ListA)
