# Grasshopper definition 0.2_Rhino_Grasshopper_Python_WickersonStudios_Geometry_Shell_Revit2021_020b.gh (Grasshopper 1.0.7)
# Copyright: bernhard muller bijoutiers
# plug-ins: Workshop

# www.wickersonstudios.com
# gitHub: Mwickerson
wickerson_s_first_grasshopper_component = WickersonsFirstGrasshopperComponent()
# Surface Analysis with
# Optimized (Tri) Planes and Visualization
surface = Surface(<surface referenced from the Rhino model>)
# Surface Analysis with Planes
surface_2 = Surface(<surface referenced from the Rhino model>)  # disabled
number_slider = Slider(7, range=0..10)  # disabled
number_slider_2 = Slider(6, range=0..10)  # disabled
number_slider_3 = Slider(1, range=0..3)  # disabled
# Surface Analysis
surface_3 = Surface(<surface referenced from the Rhino model>)  # disabled
number_slider_4 = Slider(8, range=0..10)  # disabled
number_slider_5 = Slider(6, range=0..10)  # disabled
# Surface Analysis with Planes and Visualization
surface_4 = Surface(<surface referenced from the Rhino model>)  # disabled
number_slider_6 = Slider(0, range=0..3)  # disabled
number_slider_7 = Slider(7, range=0..10)  # disabled
number_slider_8 = Slider(6, range=0..10)  # disabled
number_slider_9 = Slider(1, range=0..3)  # disabled

# ----
# Surface Division by Triangles
number_slider_10 = Slider(2, range=0..10)  # disabled
number_slider_11 = Slider(8, range=0..10)  # disabled
surface_5 = Surface(<surface referenced from the Rhino model>)  # disabled
panel = Panel("2")  # disabled
division = Division(A=number_slider_11, B=panel)  # disabled
negative = Negative(Value=division)  # disabled
ghpython_script = GhPythonScript(surface=surface_5, uDiv=number_slider_11, vDiv=number_slider_11, Step=[division, negative])  # -> out, TriPanel_out; inputs surface: Surface, uDiv: Int32, vDiv: Int32, Step: Int32; disabled
# ---------- ghpython_script: Python ----------
import rhinoscriptsyntax as rs

def TriPanel(surf):
    domainU = rs.SurfaceDomain(surf,0)
    domainV = rs.SurfaceDomain(surf,1)
    du = (domainU[1]-domainV[0])/uDiv    
    dv = (domainV[1]-domainV[0])/vDiv
    
    panels = []
    
    for i in range(uDiv):
        for j in range(vDiv):
            ptA = rs.EvaluateSurface(surf,du*(i+Step),dv*(j+Step))
            ptB = rs.EvaluateSurface(surf,du*(i+Step+1),dv*(j+Step))
            ptC = rs.EvaluateSurface(surf,du*(i+Step+1),dv*(j+Step+1))
            ptD = rs.EvaluateSurface(surf,du*(i+Step),dv*(j+Step+1))
            
            panelA = rs.AddSrfPt([ptA,ptB,ptC])
            panelB = rs.AddSrfPt([ptA,ptC,ptD])
            panels.append(panelA)
            panels.append(panelB)
    
    return panels

TriPanel_out = TriPanel(surface)
# ---------- end ghpython_script ----------
dispatch = Dispatch(List=flatten(ghpython_script.TriPanel_out), DispatchPattern=[True, False])  # -> ListA, ListB; disabled
dispatch_2 = Dispatch(List=flatten(dispatch.ListB), DispatchPattern=[True, False])  # -> ListA, ListB; disabled
dispatch_3 = Dispatch(List=flatten(dispatch.ListA), DispatchPattern=[True, False])  # -> ListA, ListB; disabled
surface_6 = Surface(dispatch_2.ListA)  # disabled
surface_7 = Surface(dispatch_3.ListA)  # disabled
surface_8 = Surface(dispatch_3.ListB)  # disabled
surface_9 = Surface(dispatch_2.ListB)  # disabled

number_slider_12 = Slider(6, range=0..10)  # disabled

# ----
# Surface Division by Diamond Sections
number_slider_13 = Slider(5, range=0..10)  # disabled
number_slider_14 = Slider(14, range=0..30)  # disabled
surface_10 = Surface(<surface referenced from the Rhino model>)  # disabled
panel_2 = Panel("2")  # disabled
division_2 = Division(A=number_slider_14, B=panel_2)  # disabled
negative_2 = Negative(Value=division_2)  # disabled
ghpython_script_2 = GhPythonScript(surface=surface_10, uDiv=number_slider_14, vDiv=number_slider_14, Step=[division_2, negative_2], SSStep=number_slider_12)  # -> out, DiaPanel_out; inputs surface: Surface, uDiv: Int32, vDiv: Int32, Step: Int32, SSStep: Int32; disabled
# ---------- ghpython_script_2: Python ----------
import rhinoscriptsyntax as rs

def DiaPanel(surf):
    domainU = rs.SurfaceDomain(surf,0)
    domainV = rs.SurfaceDomain(surf,1)
    du = (domainU[1]-domainV[0])/uDiv    
    dv = (domainV[1]-domainV[0])/vDiv
    
    panels = []
    
    for i in range(0,uDiv,SSStep):
        for j in range(0,vDiv,SSStep):
            ptA = rs.EvaluateSurface(surf,du*(i+Step+1),dv*(j+Step))
            ptB = rs.EvaluateSurface(surf,du*(i+Step+2),dv*(j+Step+1))
            ptC = rs.EvaluateSurface(surf,du*(i+Step+1),dv*(j+Step+2))
            ptD = rs.EvaluateSurface(surf,du*(i+Step),dv*(j+Step+1))
            
            panelA = rs.AddSrfPt([ptA,ptB,ptC,ptD])
            panels.append(panelA)

    for i in range(0,uDiv-2,2):
        for j in range(0,vDiv-2,2):
            ptA = rs.EvaluateSurface(surf,du*(i+Step+2),dv*(j+Step+1))
            ptB = rs.EvaluateSurface(surf,du*(i+Step+3),dv*(j+Step+2))
            ptC = rs.EvaluateSurface(surf,du*(i+Step+2),dv*(j+Step+3))
            ptD = rs.EvaluateSurface(surf,du*(i+Step+1),dv*(j+Step+2))
            
            panelB = rs.AddSrfPt([ptA,ptB,ptC,ptD])
            panels.append(panelB)
    
    return panels

DiaPanel_out = DiaPanel(surface)
# ---------- end ghpython_script_2 ----------
dispatch_4 = Dispatch(List=flatten(ghpython_script_2.DiaPanel_out), DispatchPattern=[True, False])  # -> ListA, ListB; disabled
dispatch_5 = Dispatch(List=flatten(dispatch_4.ListB), DispatchPattern=[True, False])  # -> ListA, ListB; disabled
dispatch_6 = Dispatch(List=flatten(dispatch_4.ListA), DispatchPattern=[True, False])  # -> ListA, ListB; disabled
surface_11 = Surface(dispatch_5.ListA)  # disabled
surface_12 = Surface(dispatch_6.ListA)  # disabled
surface_13 = Surface(dispatch_6.ListB)  # disabled
surface_14 = Surface(dispatch_5.ListB)  # disabled

ghpython_script_3 = GhPythonScript(surface=surface, uDiv=Slider(7, range=0..10), vDiv=Slider(6, range=0..10), Step=Slider(1, range=0..3))  # -> out, panels_out, distList_out, planeList_out; inputs surface: Surface, uDiv: Int32, vDiv: Int32, Step: Int32
# ---------- ghpython_script_3: Python ----------
import rhinoscriptsyntax as rs

panels = []
distList = []
planeList = []

domainU = rs.SurfaceDomain(surface,0)
domainV = rs.SurfaceDomain(surface,1)
du = (domainU[1]-domainV[0])/uDiv    
dv = (domainV[1]-domainV[0])/vDiv

for i in range(uDiv):
    for j in range(vDiv):
        ptA = rs.EvaluateSurface(surface,du*(i+Step),dv*(j+Step))
        ptB = rs.EvaluateSurface(surface,du*(i+Step+1),dv*(j+Step))
        ptC = rs.EvaluateSurface(surface,du*(i+Step+1),dv*(j+Step+1))
        ptD = rs.EvaluateSurface(surface,du*(i+Step),dv*(j+Step+1))
        
        panel = rs.AddSrfPt([ptA,ptB,ptC,ptD])
        panels.append(panel)
        plane = rs.PlaneFromPoints(ptA,ptB,ptC)
        dist = abs(rs.DistanceToPlane(plane,ptD))
        distList.append(dist)
        planeList.append(plane)

panels_out = panels
distList_out = distList
planeList_out = planeList
# ---------- end ghpython_script_3 ----------
ghpython_script_4 = GhPythonScript(surface=surface_4, uDiv=number_slider_7, vDiv=number_slider_8, Step=number_slider_9)  # -> out, panels_out, distList_out, planeList_out; inputs surface: Surface, uDiv: Int32, vDiv: Int32, Step: Int32; disabled; same code as ghpython_script_3
ghpython_script_5 = GhPythonScript(surface=surface_2, uDiv=number_slider, vDiv=number_slider_2, Step=number_slider_3)  # -> out, panels_out, distList_out, planeList_out; inputs surface: Surface, uDiv: Int32, vDiv: Int32, Step: Int32; disabled; same code as ghpython_script_3
ghpython_script_6 = GhPythonScript(surface=surface_3, uDiv=number_slider_5, vDiv=number_slider_4, Step=number_slider_6)  # -> out, panels_out, distList_out; inputs surface: Surface, uDiv: Int32, vDiv: Int32, Step: Int32; disabled
# ---------- ghpython_script_6: Python ----------
import rhinoscriptsyntax as rs

panels = []

domainU = rs.SurfaceDomain(surface,0)
domainV = rs.SurfaceDomain(surface,1)
du = (domainU[1]-domainV[0])/uDiv    
dv = (domainV[1]-domainV[0])/vDiv

for i in range(uDiv):
    for j in range(vDiv):
        ptA = rs.EvaluateSurface(surface,du*(i+Step),dv*(j+Step))
        ptB = rs.EvaluateSurface(surface,du*(i+Step+1),dv*(j+Step))
        ptC = rs.EvaluateSurface(surface,du*(i+Step+1),dv*(j+Step+1))
        ptD = rs.EvaluateSurface(surface,du*(i+Step),dv*(j+Step+1))
        
        panel = rs.AddSrfPt([ptA,ptB,ptC,ptD])
        panels.append(panel)

panels_out = panels
# ---------- end ghpython_script_6 ----------
panel_3 = Panel(ghpython_script_3.distList_out)
surface_15 = Surface(ghpython_script_5.panels_out)  # disabled
plane = Plane(ghpython_script_3.planeList_out)
panel_4 = Panel(ghpython_script_6.distList_out)  # disabled
panel_5 = Panel(ghpython_script_4.distList_out)  # disabled
surface_16 = Surface(ghpython_script_6.panels_out)  # disabled
plane_2 = Plane(ghpython_script_4.planeList_out)  # disabled
plane_3 = Plane(ghpython_script_5.planeList_out)  # disabled
bounds = Bounds(Numbers=ghpython_script_3.distList_out)
bounds_2 = Bounds(Numbers=ghpython_script_4.distList_out)  # disabled
surface_17 = Surface(ghpython_script_3.panels_out)
surface_18 = Surface(ghpython_script_4.panels_out)  # disabled
panel_6 = Panel(ghpython_script_5.distList_out)  # disabled
deconstruct_domain = DeconstructDomain(Domain=bounds)  # -> Start, End
deconstruct_domain_2 = DeconstructDomain(Domain=bounds_2)  # -> Start, End; disabled
gradient = Gradient(
    LowerLimit=deconstruct_domain.Start,
    UpperLimit=deconstruct_domain.End,
    Parameter=ghpython_script_3.distList_out,
    stops=[0: RGB(0, 128, 0), 0.5: RGB(255, 255, 0), 1: RGB(255, 0, 0)])
gradient_2 = Gradient(
    LowerLimit=deconstruct_domain_2.Start,
    UpperLimit=deconstruct_domain_2.End,
    Parameter=ghpython_script_4.distList_out,
    stops=[0: RGB(0, 128, 0), 0.5: RGB(255, 255, 0), 1: RGB(255, 0, 0)])  # disabled
custom_preview = CustomPreview(Geometry=surface_17, Material=gradient)
custom_preview_2 = CustomPreview(Geometry=surface_18, Material=gradient_2)  # disabled
