# Grasshopper definition 03_Rhino_Grasshopper_Python_WickersonStudios_Geometry_Mesh_Create_3.0_028.gh (Grasshopper 1.0.7)
# Copyright: bernhard muller bijoutiers
# plug-ins: Workshop, Bifocals

# www.wickersonstudios.com
# gitHub: Mwickerson
# Mesh Verticies
wickerson_s_first_grasshopper_component = WickersonsFirstGrasshopperComponent()
number_slider = Slider(10, range=0..10)  # disabled
number_slider_2 = Slider(10, range=0..10)  # disabled
number_slider_3 = Slider(10, range=0..10)  # disabled
# Triangle Mesh Create
number_slider_4 = Slider(22, range=0..100)  # disabled
number_slider_5 = Slider(10, range=0..10)  # disabled
# Mesh Face
number_slider_6 = Slider(2, range=0..10)  # disabled
# Mesh Create
number_slider_7 = Slider(22, range=0..100)  # disabled
number_slider_8 = Slider(2, range=0..10)  # disabled
boundary = Boundary({Plane=PlaneXY(52.03645833, 51.76822917, 0), Size=Domain2(u=-92.00520833..92.00520833, v=-86.88802083..86.88802083)})  # disabled
boundary_2 = Boundary({Plane=PlaneXY(52.03645833, 51.76822917, 0), Size=Domain2(u=-92.00520833..92.00520833, v=-86.88802083..86.88802083)})  # disabled

# ----
# SubDivision Triangle Mesh 001
# SubDivision Triangle Mesh 001 with Levels
# SubDivision Triangle Mesh 001 with Levels and Lift
number_slider_9 = Slider(2, range=1..4)  # disabled
number_slider_10 = Slider(3, range=0..10)  # disabled
number_slider_11 = Slider(1, range=0..10)  # disabled
mesh_plane = MeshPlane(
    Boundary={Plane=PlaneXY(0, 0, 0), Size=Domain2(u=-10..10, v=-10..10)},
    WidthCount=number_slider_9,
    HeightCount=number_slider_9)  # -> Mesh, Area; disabled
mesh_plane_2 = MeshPlane(
    Boundary={Plane=PlaneXY(0, 0, 0), Size=Domain2(u=-10..10, v=-10..10)},
    WidthCount=number_slider_10,
    HeightCount=number_slider_10)  # -> Mesh, Area; disabled
mesh_plane_3 = MeshPlane(
    Boundary={Plane=PlaneXY(0, 0, 0), Size=Domain2(u=-10..10, v=-10..10)},
    WidthCount=number_slider_11,
    HeightCount=number_slider_11)  # -> Mesh, Area; disabled
number_slider_12 = Slider(3, range=0..5)  # disabled
number_slider_13 = Slider(4.1, range=0..10)  # disabled
triangulate = Triangulate(Mesh=mesh_plane_3.Mesh)  # -> Mesh, Count; disabled
number_slider_14 = Slider(1, range=0..5)  # disabled
triangulate_2 = Triangulate(Mesh=mesh_plane.Mesh)  # -> Mesh, Count; disabled
triangulate_3 = Triangulate(Mesh=mesh_plane_2.Mesh)  # -> Mesh, Count; disabled
ghpython_script = GhPythonScript(mesh=triangulate.Mesh)  # -> out, mesh_out; inputs mesh: Mesh; disabled
# ---------- ghpython_script: Python ----------
import rhinoscriptsyntax as rs

vtxCount = rs.MeshVertexCount(mesh)
vtx = rs.MeshVertices(mesh)
faceCount = rs.MeshFaceCount(mesh)
faceList = []

for i in range(faceCount):
    faceVtx = rs.MeshFaceVertices(mesh)
    vtxIndex1 = faceVtx[i][0]
    vtxIndex2 = faceVtx[i][1]
    vtxIndex3 = faceVtx[i][2]  
    
    v1 = vtx[vtxIndex1]
    v2 = vtx[vtxIndex2]
    v3 = vtx[vtxIndex3]
    v4 = (v1+v2+v3)/3
    
    vtx.append(v4)
    vtxIndex4 = vtxCount
    
    faces = [(vtxIndex1,vtxIndex2,vtxIndex4),(vtxIndex2,vtxIndex3,vtxIndex4),(vtxIndex3,vtxIndex1,vtxIndex4)]
    faceList.extend(faces)
    
    vtxCount = vtxCount+1

mesh = rs.AddMesh(vtx,faceList)

mesh_out = mesh
# ---------- end ghpython_script ----------
ghpython_script_2 = GhPythonScript(mesh=triangulate_2.Mesh, level=number_slider_12, d=number_slider_13)  # -> out, mesh_out; inputs mesh: Mesh, level: Int32; disabled
# ---------- ghpython_script_2: Python ----------
import rhinoscriptsyntax as rs

for j in range(level):
    vtxCount = rs.MeshVertexCount(mesh)
    vtx = rs.MeshVertices(mesh)
    faceCount = rs.MeshFaceCount(mesh)
    faceNormal = rs.MeshFaceNormals(mesh)
    faceList = []
    
    for i in range(faceCount):
        faceVtx = rs.MeshFaceVertices(mesh)
        vtxIndex1 = faceVtx[i][0]
        vtxIndex2 = faceVtx[i][1]
        vtxIndex3 = faceVtx[i][2]  
        
        v1 = vtx[vtxIndex1]
        v2 = vtx[vtxIndex2]
        v3 = vtx[vtxIndex3]
        v4 = (v1+v2+v3)/3+(faceNormal[i]*d)*(0.5**j)
        
        vtx.append(v4)
        vtxIndex4 = vtxCount
        
        faces = [(vtxIndex1,vtxIndex2,vtxIndex4),(vtxIndex2,vtxIndex3,vtxIndex4),(vtxIndex3,vtxIndex1,vtxIndex4)]
        faceList.extend(faces)
        
        vtxCount = vtxCount+1
    
    mesh = rs.AddMesh(vtx,faceList)
    
    mesh_out = mesh
# ---------- end ghpython_script_2 ----------
ghpython_script_3 = GhPythonScript(mesh=triangulate_3.Mesh, level=number_slider_14)  # -> out, mesh_out; inputs mesh: Mesh, level: Int32; disabled
# ---------- ghpython_script_3: Python ----------
import rhinoscriptsyntax as rs

for j in range(level):
    vtxCount = rs.MeshVertexCount(mesh)
    vtx = rs.MeshVertices(mesh)
    faceCount = rs.MeshFaceCount(mesh)
    faceList = []
    
    for i in range(faceCount):
        faceVtx = rs.MeshFaceVertices(mesh)
        vtxIndex1 = faceVtx[i][0]
        vtxIndex2 = faceVtx[i][1]
        vtxIndex3 = faceVtx[i][2]  
        
        v1 = vtx[vtxIndex1]
        v2 = vtx[vtxIndex2]
        v3 = vtx[vtxIndex3]
        v4 = (v1+v2+v3)/3
        
        vtx.append(v4)
        vtxIndex4 = vtxCount
        
        faces = [(vtxIndex1,vtxIndex2,vtxIndex4),(vtxIndex2,vtxIndex3,vtxIndex4),(vtxIndex3,vtxIndex1,vtxIndex4)]
        faceList.extend(faces)
        
        vtxCount = vtxCount+1
    
    mesh = rs.AddMesh(vtx,faceList)
    
    mesh_out = mesh
# ---------- end ghpython_script_3 ----------
mesh = Mesh(ghpython_script.mesh_out)  # disabled
mesh_2 = Mesh(ghpython_script_2.mesh_out)  # disabled
mesh_3 = Mesh(ghpython_script_3.mesh_out)  # disabled

number_slider_15 = Slider(28, range=0..60)  # disabled
number_slider_16 = Slider(60, range=0..60)  # disabled
number_slider_17 = Slider(0, range=0..60)  # disabled
number_slider_18 = Slider(13, range=0..60)  # disabled
number_slider_19 = Slider(76, range=0..100)  # disabled
number_slider_20 = Slider(27, range=0..100)  # disabled
number_slider_21 = Slider(31, range=0..100)  # disabled
number_slider_22 = Slider(34, range=0..100)  # disabled
mesh_plane_4 = MeshPlane(Boundary=boundary, WidthCount=number_slider_6, HeightCount=number_slider_6)  # -> Mesh, Area; disabled
mesh_plane_5 = MeshPlane(Boundary=boundary_2, WidthCount=number_slider_8, HeightCount=number_slider_8)  # -> Mesh, Area; disabled
square = Square(Plane=PlaneXY(0, 0, 0), Size=number_slider_4, ExtentX=number_slider_2, ExtentY=number_slider)  # -> Cells, flatten(Points); disabled
square_2 = Square(Plane=PlaneXY(0, 0, 0), Size=number_slider_7, ExtentX=number_slider_5, ExtentY=number_slider_3)  # -> Cells, flatten(Points); disabled
# SubDivision Triangle Mesh 002
number_slider_23 = Slider(1, range=0..10)  # disabled
ghpython_script_4 = GhPythonScript(mesh=mesh_plane_4.Mesh)  # -> out, vertices_out, vertexCount_out; inputs mesh: Mesh; disabled
# ---------- ghpython_script_4: Python ----------
import rhinoscriptsyntax as rs

vertices = rs.MeshVertices(mesh)
vertices_out = vertices

vertexCount = rs.MeshVertexCount(mesh)
vertexCount_out = vertexCount
# ---------- end ghpython_script_4 ----------
ghpython_script_5 = GhPythonScript(mesh=mesh_plane_5.Mesh)  # -> out, faceCount_out, faceNormals_out, faceVertices_out; inputs mesh: Mesh; disabled
# ---------- ghpython_script_5: Python ----------
import rhinoscriptsyntax as rs

faceCount = rs.MeshFaceCount(mesh)
faceCount_out = faceCount

faceNormals = rs.MeshFaceNormals(mesh)
faceNormals_out = faceNormals

faceVertices = rs.MeshFaceVertices(mesh)
faceVertices_out = faceVertices
# ---------- end ghpython_script_5 ----------
point_list = PointList(Points=square.Points)  # disabled
ghpython_script_6 = GhPythonScript(vertices=square.Points, a=number_slider_15, b=number_slider_17, c=number_slider_18, d=number_slider_16)  # -> out, mesh_out; inputs vertices: list of Point3d, a: Int32, b: Int32, c: Int32, d: Int32; disabled
# ---------- ghpython_script_6: Python ----------
import rhinoscriptsyntax as rs

faces = [(a,b,c,d),((a+b),(b+c),(c+d),(d+a)),((a+b+c),(b+c+d),(c+d+a),(d+a+b))]
mesh = rs.AddMesh(vertices,faces)
mesh_out = mesh
# ---------- end ghpython_script_6 ----------
point_list_2 = PointList(Points=square_2.Points)  # disabled
ghpython_script_7 = GhPythonScript(vertices=square_2.Points, a=number_slider_19, b=number_slider_21, c=number_slider_22, d=number_slider_20)  # -> out, mesh_out; inputs vertices: list of Point3d, a: Int32, b: Int32, c: Int32, d: Int32; disabled
# ---------- ghpython_script_7: Python ----------
import rhinoscriptsyntax as rs

faces = [(a,b,c,d),((a+b),(b+c),(c+d),(d+a))]
mesh = rs.AddMesh(vertices,faces)
mesh_out = mesh
# ---------- end ghpython_script_7 ----------
mesh_plane_6 = MeshPlane(
    Boundary={Plane=PlaneXY(0, 0, 0), Size=Domain2(u=-10..10, v=-10..10)},
    WidthCount=number_slider_23,
    HeightCount=number_slider_23)  # -> Mesh, Area; disabled
panel = Panel(ghpython_script_5.faceCount_out)  # disabled
panel_2 = Panel(ghpython_script_4.vertexCount_out)  # disabled
mesh_4 = Mesh(graft(ghpython_script_6.mesh_out))  # disabled
mesh_5 = Mesh(graft(ghpython_script_7.mesh_out))  # disabled
panel_3 = Panel(ghpython_script_5.faceNormals_out)  # disabled
panel_4 = Panel(ghpython_script_5.faceVertices_out)  # disabled
triangulate_4 = Triangulate(Mesh=mesh_plane_6.Mesh)  # -> Mesh, Count; disabled
param_viewer = ParamViewer(mesh_4)  # disabled
panel_5 = Panel(ghpython_script_4.vertices_out)  # disabled
param_viewer_2 = ParamViewer(mesh_5)  # disabled
mesh_union = MeshUnion(Meshes=mesh_4)  # disabled
mesh_union_2 = MeshUnion(Meshes=mesh_5)  # disabled
panel_6 = Panel(mesh_4)  # disabled
panel_7 = Panel(mesh_5)  # disabled
ghpython_script_8 = GhPythonScript(mesh=triangulate_4.Mesh)  # -> out, mesh_out; inputs mesh: Mesh; disabled; same code as ghpython_script
weld_mesh = WeldMesh(Mesh=mesh_union, Angle=3.141592654)  # disabled
weld_mesh_2 = WeldMesh(Mesh=mesh_union_2, Angle=3.141592654)  # disabled
mesh_6 = Mesh(ghpython_script_8.mesh_out)  # disabled
panel_8 = Panel(weld_mesh)  # disabled
panel_9 = Panel(weld_mesh_2)  # disabled
mesh_edges = MeshEdges(Mesh=weld_mesh)  # -> NakedEdges, InteriorEdges, NonManifoldEdges; disabled
mesh_edges_2 = MeshEdges(Mesh=weld_mesh_2)  # -> NakedEdges, InteriorEdges, NonManifoldEdges; disabled
join_curves = JoinCurves(Curves=mesh_edges.NakedEdges, Preserve=False)  # disabled
join_curves_2 = JoinCurves(Curves=mesh_edges_2.NakedEdges, Preserve=False)  # disabled
boundary_surfaces = BoundarySurfaces(Edges=join_curves)  # disabled
boundary_surfaces_2 = BoundarySurfaces(Edges=join_curves_2)  # disabled
unit_z = UnitZ(Factor=number_slider_4)  # disabled
unit_z_2 = UnitZ(Factor=number_slider_7)  # disabled
extrude = Extrude(Base=boundary_surfaces, Direction=unit_z)  # disabled
extrude_2 = Extrude(Base=boundary_surfaces_2, Direction=unit_z_2)  # disabled
explode_tree = ExplodeTree(Data=graft(extrude))  # -> _00000, Branch1, Branch2, Branch3, Branch4, Branch5, Branch6; disabled
explode_tree_2 = ExplodeTree(Data=graft(extrude_2))  # -> _00000, _00001, Branch2, Branch3, Branch4, Branch5, Branch6; disabled
geometry = Geometry(explode_tree.Branch1)  # disabled
geometry_2 = Geometry(explode_tree.Branch3)  # disabled
geometry_3 = Geometry(explode_tree.Branch4)  # disabled
geometry_4 = Geometry(explode_tree.Branch5)  # disabled
geometry_5 = Geometry(explode_tree._00000)  # disabled
geometry_6 = Geometry(explode_tree.Branch2)  # disabled
geometry_7 = Geometry(explode_tree_2._00000)  # disabled
geometry_8 = Geometry(explode_tree_2._00001)  # disabled
geometry_9 = Geometry(explode_tree_2.Branch3)  # disabled
geometry_10 = Geometry(explode_tree_2.Branch4)  # disabled
geometry_11 = Geometry(explode_tree_2.Branch5)  # disabled
geometry_12 = Geometry(explode_tree_2.Branch2)  # disabled
