# Grasshopper definition 03_Rhino_Grasshopper_Python_WickersonStudios_Geometry_Mesh_Create_3.0_029.gh (Grasshopper 1.0.7)
# Copyright: bernhard muller bijoutiers
# plug-ins: Workshop, Bifocals

# www.wickersonstudios.com
# gitHub: Mwickerson
# Mesh Verticies
wickerson_s_first_grasshopper_component = WickersonsFirstGrasshopperComponent()  # disabled
number_slider = Slider(10, range=0..10)  # disabled
number_slider_2 = Slider(10, range=0..10)  # disabled
number_slider_3 = Slider(10, range=0..10)  # disabled
number_slider_4 = Slider(10, range=0..10)  # disabled
# Triangle Mesh Create
number_slider_5 = Slider(22, range=0..100)  # disabled
# Mesh Create
number_slider_6 = Slider(22, range=0..100)  # disabled
# Mesh Face
number_slider_7 = Slider(2, range=0..10)  # disabled
number_slider_8 = Slider(2, range=0..10)  # disabled
boundary = Boundary({Plane=PlaneXY(52.03645833, 51.76822917, 0), Size=Domain2(u=-92.00520833..92.00520833, v=-86.88802083..86.88802083)})  # disabled
boundary_2 = Boundary({Plane=PlaneXY(52.03645833, 51.76822917, 0), Size=Domain2(u=-92.00520833..92.00520833, v=-86.88802083..86.88802083)})  # disabled

# ----
# SubDivision Triangle Mesh 001
# SubDivision Triangle Mesh 001 with Levels
# SubDivision Triangle Mesh 001 with Levels and Lift
number_slider_9 = Slider(1, range=1..4)  # disabled
number_slider_10 = Slider(3, range=0..10)  # disabled
number_slider_11 = Slider(1, range=0..10)  # disabled
mesh_plane = MeshPlane(
    Boundary={Plane=PlaneXY(0, 0, 0), Size=Domain2(u=-10..10, v=-10..10)},
    WidthCount=number_slider_9,
    HeightCount=number_slider_9)  # -> Mesh, Area; disabled
mesh_plane_2 = MeshPlane(
    Boundary={Plane=PlaneXY(0, 0, 0), Size=Domain2(u=-10..10, v=-10..10)},
    WidthCount=number_slider_10,
    HeightCount=number_slider_10)  # -> Mesh, Area; disabled
mesh_plane_3 = MeshPlane(
    Boundary={Plane=PlaneXY(0, 0, 0), Size=Domain2(u=-10..10, v=-10..10)},
    WidthCount=number_slider_11,
    HeightCount=number_slider_11)  # -> Mesh, Area; disabled
number_slider_12 = Slider(1, range=0..5)  # disabled
number_slider_13 = Slider(4.1, range=0..10)  # disabled
triangulate = Triangulate(Mesh=mesh_plane_3.Mesh)  # -> Mesh, Count; disabled
number_slider_14 = Slider(1, range=0..5)  # disabled
triangulate_2 = Triangulate(Mesh=mesh_plane.Mesh)  # -> Mesh, Count; disabled
triangulate_3 = Triangulate(Mesh=mesh_plane_2.Mesh)  # -> Mesh, Count; disabled
ghpython_script = GhPythonScript(mesh=triangulate.Mesh)  # -> out, mesh_out; inputs mesh: Mesh; disabled
# ---------- ghpython_script: Python ----------
import rhinoscriptsyntax as rs

vtxCount = rs.MeshVertexCount(mesh)
vtx = rs.MeshVertices(mesh)
faceCount = rs.MeshFaceCount(mesh)
faceList = []

for i in range(faceCount):
    faceVtx = rs.MeshFaceVertices(mesh)
    vtxIndex1 = faceVtx[i][0]
    vtxIndex2 = faceVtx[i][1]
    vtxIndex3 = faceVtx[i][2]  
    
    v1 = vtx[vtxIndex1]
    v2 = vtx[vtxIndex2]
    v3 = vtx[vtxIndex3]
    v4 = (v1+v2+v3)/3
    
    vtx.append(v4)
    vtxIndex4 = vtxCount
    
    faces = [(vtxIndex1,vtxIndex2,vtxIndex4),(vtxIndex2,vtxIndex3,vtxIndex4),(vtxIndex3,vtxIndex1,vtxIndex4)]
    faceList.extend(faces)
    
    vtxCount = vtxCount+1

mesh = rs.AddMesh(vtx,faceList)

mesh_out = mesh
# ---------- end ghpython_script ----------
ghpython_script_2 = GhPythonScript(mesh=triangulate_2.Mesh, level=number_slider_12, d=number_slider_13)  # -> out, mesh_out; inputs mesh: Mesh, level: Int32; disabled
# ---------- ghpython_script_2: Python ----------
import rhinoscriptsyntax as rs

for j in range(level):
    vtxCount = rs.MeshVertexCount(mesh)
    vtx = rs.MeshVertices(mesh)
    faceCount = rs.MeshFaceCount(mesh)
    faceNormal = rs.MeshFaceNormals(mesh)
    faceList = []
    
    for i in range(faceCount):
        faceVtx = rs.MeshFaceVertices(mesh)
        vtxIndex1 = faceVtx[i][0]
        vtxIndex2 = faceVtx[i][1]
        vtxIndex3 = faceVtx[i][2]  
        
        v1 = vtx[vtxIndex1]
        v2 = vtx[vtxIndex2]
        v3 = vtx[vtxIndex3]
        v4 = (v1+v2+v3)/3+(faceNormal[i]*d)*(0.5**j)
        
        vtx.append(v4)
        vtxIndex4 = vtxCount
        
        faces = [(vtxIndex1,vtxIndex2,vtxIndex4),(vtxIndex2,vtxIndex3,vtxIndex4),(vtxIndex3,vtxIndex1,vtxIndex4)]
        faceList.extend(faces)
        
        vtxCount = vtxCount+1
    
    mesh = rs.AddMesh(vtx,faceList)
    
    mesh_out = mesh
# ---------- end ghpython_script_2 ----------
ghpython_script_3 = GhPythonScript(mesh=triangulate_3.Mesh, level=number_slider_14)  # -> out, mesh_out; inputs mesh: Mesh, level: Int32; disabled
# ---------- ghpython_script_3: Python ----------
import rhinoscriptsyntax as rs

for j in range(level):
    vtxCount = rs.MeshVertexCount(mesh)
    vtx = rs.MeshVertices(mesh)
    faceCount = rs.MeshFaceCount(mesh)
    faceList = []
    
    for i in range(faceCount):
        faceVtx = rs.MeshFaceVertices(mesh)
        vtxIndex1 = faceVtx[i][0]
        vtxIndex2 = faceVtx[i][1]
        vtxIndex3 = faceVtx[i][2]  
        
        v1 = vtx[vtxIndex1]
        v2 = vtx[vtxIndex2]
        v3 = vtx[vtxIndex3]
        v4 = (v1+v2+v3)/3
        
        vtx.append(v4)
        vtxIndex4 = vtxCount
        
        faces = [(vtxIndex1,vtxIndex2,vtxIndex4),(vtxIndex2,vtxIndex3,vtxIndex4),(vtxIndex3,vtxIndex1,vtxIndex4)]
        faceList.extend(faces)
        
        vtxCount = vtxCount+1
    
    mesh = rs.AddMesh(vtx,faceList)
    
    mesh_out = mesh
# ---------- end ghpython_script_3 ----------
mesh = Mesh(ghpython_script.mesh_out)  # disabled
mesh_2 = Mesh(ghpython_script_2.mesh_out)  # disabled
mesh_3 = Mesh(ghpython_script_3.mesh_out)  # disabled

# ----
# SubDivision Triangle Mesh 002
# SubDivision Triangle Mesh 002 with Levels
# SubDivision Triangle Mesh 002 with Levels and Lift
number_slider_15 = Slider(3, range=0..10)  # disabled
number_slider_16 = Slider(3, range=0..10)  # disabled
number_slider_17 = Slider(3, range=0..10)  # disabled
panel = Panel("3")  # disabled
panel_2 = Panel("3")  # disabled
panel_3 = Panel("3")  # disabled
polygon = Polygon(Plane=PlaneXY(0, 0, 0), Radius=panel, Segments=number_slider_15, FilletRadius=0)  # -> Polygon, Length; disabled
polygon_2 = Polygon(Plane=PlaneXY(0, 0, 0), Radius=panel_2, Segments=number_slider_16, FilletRadius=0)  # -> Polygon, Length; disabled
polygon_3 = Polygon(Plane=PlaneXY(0, 0, 0), Radius=panel_3, Segments=number_slider_17, FilletRadius=0)  # -> Polygon, Length; disabled
number_slider_18 = Slider(3, range=1..4)  # disabled
number_slider_19 = Slider(2, range=1..4)  # disabled
number_slider_20 = Slider(4.5, range=0..10)  # disabled
mesh_brep = MeshBrep(
    Brep=polygon.Polygon,
    Settings={GridMaxCount=0, GridMinCount=16, JaggedSeams=False, MaxEdgeLength=0, MinEdgeLength=0.0001, MinTolerance=0, Refine=True, RefineAngle=0, RelativeTolerance=0.65, SimplePlanes=True, Tolerance=0})  # disabled
mesh_brep_2 = MeshBrep(
    Brep=polygon_2.Polygon,
    Settings={GridMaxCount=0, GridMinCount=16, JaggedSeams=False, MaxEdgeLength=0, MinEdgeLength=0.0001, MinTolerance=0, Refine=True, RefineAngle=0, RelativeTolerance=0.65, SimplePlanes=True, Tolerance=0})  # disabled
mesh_brep_3 = MeshBrep(
    Brep=polygon_3.Polygon,
    Settings={GridMaxCount=0, GridMinCount=16, JaggedSeams=False, MaxEdgeLength=0, MinEdgeLength=0.0001, MinTolerance=0, Refine=True, RefineAngle=0, RelativeTolerance=0.65, SimplePlanes=True, Tolerance=0})  # disabled
ghpython_script_4 = GhPythonScript(mesh=mesh_brep, level=number_slider_18, d=number_slider_20)  # -> out, mesh_out; inputs mesh: Mesh, level: Int32; disabled
# ---------- ghpython_script_4: Python ----------
import rhinoscriptsyntax as rs

for j in range(level):
    vtxCount = rs.MeshVertexCount(mesh)
    vtx = rs.MeshVertices(mesh)
    faceCount = rs.MeshFaceCount(mesh)
    faceNormal = rs.MeshFaceNormals(mesh)
    faceList = []
    
    for i in range(faceCount):
        faceVtx = rs.MeshFaceVertices(mesh)
        vtxIndex1 = faceVtx[i][0]
        vtxIndex2 = faceVtx[i][1]
        vtxIndex3 = faceVtx[i][2]  
        
        v1 = vtx[vtxIndex1]
        v2 = vtx[vtxIndex2]
        v3 = vtx[vtxIndex3]
        v4 = (v1+v2)/2+(faceNormal[i]*d)*(0.5**j)
        v5 = (v2+v3)/2+(faceNormal[i]*d)*(0.5**j)
        v6 = (v3+v1)/2+(faceNormal[i]*d)*(0.5**j)
        
        
        vtx.append(v4)
        vtxIndex4 = vtxCount
        vtx.append(v5)
        vtxIndex5 = vtxCount+1
        vtx.append(v6)
        vtxIndex6 = vtxCount+2
        
        faces = [(vtxIndex1,vtxIndex4,vtxIndex6),(vtxIndex2,vtxIndex5,vtxIndex4),(vtxIndex3,vtxIndex6,vtxIndex5),(vtxIndex4,vtxIndex5,vtxIndex6)]
        faceList.extend(faces)
        
        vtxCount = vtxCount+3
    
    mesh = rs.AddMesh(vtx,faceList)
    
    mesh_out = mesh
# ---------- end ghpython_script_4 ----------
ghpython_script_5 = GhPythonScript(mesh=mesh_brep_2, level=number_slider_19)  # -> out, mesh_out; inputs mesh: Mesh, level: Int32; disabled
# ---------- ghpython_script_5: Python ----------
import rhinoscriptsyntax as rs

for j in range(level):
    vtxCount = rs.MeshVertexCount(mesh)
    vtx = rs.MeshVertices(mesh)
    faceCount = rs.MeshFaceCount(mesh)
    faceList = []
    
    for i in range(faceCount):
        faceVtx = rs.MeshFaceVertices(mesh)
        vtxIndex1 = faceVtx[i][0]
        vtxIndex2 = faceVtx[i][1]
        vtxIndex3 = faceVtx[i][2]  
        
        v1 = vtx[vtxIndex1]
        v2 = vtx[vtxIndex2]
        v3 = vtx[vtxIndex3]
        v4 = (v1+v2)/2
        v5 = (v2+v3)/2
        v6 = (v3+v1)/2
        
        
        vtx.append(v4)
        vtxIndex4 = vtxCount
        vtx.append(v5)
        vtxIndex5 = vtxCount+1
        vtx.append(v6)
        vtxIndex6 = vtxCount+2
        
        faces = [(vtxIndex1,vtxIndex4,vtxIndex6),(vtxIndex2,vtxIndex5,vtxIndex4),(vtxIndex3,vtxIndex6,vtxIndex5),(vtxIndex4,vtxIndex5,vtxIndex6)]
        faceList.extend(faces)
        
        vtxCount = vtxCount+3
    
    mesh = rs.AddMesh(vtx,faceList)
    
    mesh_out = mesh
# ---------- end ghpython_script_5 ----------
ghpython_script_6 = GhPythonScript(mesh=mesh_brep_3)  # -> out, mesh_out; inputs mesh: Mesh; disabled
# ---------- ghpython_script_6: Python ----------
import rhinoscriptsyntax as rs

vtxCount = rs.MeshVertexCount(mesh)
vtx = rs.MeshVertices(mesh)
faceCount = rs.MeshFaceCount(mesh)
faceList = []

for i in range(faceCount):
    faceVtx = rs.MeshFaceVertices(mesh)
    vtxIndex1 = faceVtx[i][0]
    vtxIndex2 = faceVtx[i][1]
    vtxIndex3 = faceVtx[i][2]  
    
    v1 = vtx[vtxIndex1]
    v2 = vtx[vtxIndex2]
    v3 = vtx[vtxIndex3]
    v4 = (v1+v2)/2
    v5 = (v2+v3)/2
    v6 = (v3+v1)/2
    
    
    vtx.append(v4)
    vtxIndex4 = vtxCount
    vtx.append(v5)
    vtxIndex5 = vtxCount+1
    vtx.append(v6)
    vtxIndex6 = vtxCount+2
    
    faces = [(vtxIndex1,vtxIndex4,vtxIndex6),(vtxIndex2,vtxIndex5,vtxIndex4),(vtxIndex3,vtxIndex6,vtxIndex5),(vtxIndex4,vtxIndex5,vtxIndex6)]
    faceList.extend(faces)
    
    vtxCount = vtxCount+3

mesh = rs.AddMesh(vtx,faceList)

mesh_out = mesh
# ---------- end ghpython_script_6 ----------
mesh_4 = Mesh(ghpython_script_4.mesh_out)  # disabled
mesh_5 = Mesh(ghpython_script_5.mesh_out)  # disabled
mesh_6 = Mesh(ghpython_script_6.mesh_out)  # disabled

number_slider_21 = Slider(28, range=0..60)  # disabled
number_slider_22 = Slider(47, range=0..60)  # disabled
number_slider_23 = Slider(0, range=0..60)  # disabled
number_slider_24 = Slider(24, range=0..60)  # disabled
mesh_plane_4 = MeshPlane(Boundary=boundary, WidthCount=number_slider_7, HeightCount=number_slider_7)  # -> Mesh, Area; disabled
mesh_plane_5 = MeshPlane(Boundary=boundary_2, WidthCount=number_slider_8, HeightCount=number_slider_8)  # -> Mesh, Area; disabled
square = Square(Plane=PlaneXY(0, 0, 0), Size=number_slider_5, ExtentX=number_slider_2, ExtentY=number_slider)  # -> Cells, flatten(Points); disabled
square_2 = Square(Plane=PlaneXY(0, 0, 0), Size=number_slider_6, ExtentX=number_slider_4, ExtentY=number_slider_3)  # -> Cells, flatten(Points); disabled

# ----
# SubDivision Quad Mesh 003
# SubDivision Quad Mesh 003 with Levels
# SubDivision Quad Mesh 003 with  Holes
# SubDivision Quad Mesh 003 with  Holes and Levels
# SubDivision Quad Mesh 003 with  Holes and Levels and Lift
number_slider_25 = Slider(3, range=1..5)
number_slider_26 = Slider(3, range=1..5)  # disabled
number_slider_27 = Slider(3, range=1..5)  # disabled
number_slider_28 = Slider(2, range=1..5)  # disabled
number_slider_29 = Slider(2, range=1..5)  # disabled
number_slider_30 = Slider(2, range=1..4)  # disabled
number_slider_31 = Slider(2, range=0..5)
number_slider_32 = Slider(2, range=1..4)  # disabled
mesh_plane_6 = MeshPlane(
    Boundary={Plane=PlaneXY(0, 0, 0), Size=Domain2(u=-10..10, v=-10..10)},
    WidthCount=number_slider_25,
    HeightCount=number_slider_25)  # -> Mesh, Area
mesh_plane_7 = MeshPlane(
    Boundary={Plane=PlaneXY(0, 0, 0), Size=Domain2(u=-10..10, v=-10..10)},
    WidthCount=number_slider_26,
    HeightCount=number_slider_26)  # -> Mesh, Area; disabled
mesh_plane_8 = MeshPlane(
    Boundary={Plane=PlaneXY(0, 0, 0), Size=Domain2(u=-10..10, v=-10..10)},
    WidthCount=number_slider_27,
    HeightCount=number_slider_27)  # -> Mesh, Area; disabled
mesh_plane_9 = MeshPlane(
    Boundary={Plane=PlaneXY(0, 0, 0), Size=Domain2(u=-10..10, v=-10..10)},
    WidthCount=number_slider_28,
    HeightCount=number_slider_28)  # -> Mesh, Area; disabled
mesh_plane_10 = MeshPlane(
    Boundary={Plane=PlaneXY(0, 0, 0), Size=Domain2(u=-10..10, v=-10..10)},
    WidthCount=number_slider_29,
    HeightCount=number_slider_29)  # -> Mesh, Area; disabled
ghpython_script_7 = GhPythonScript(mesh=mesh_plane_6.Mesh, level=Slider(2, range=1..4), d=Slider(1.9, range=0..10))  # -> out, mesh_out; inputs mesh: Mesh, level: Int32
# ---------- ghpython_script_7: Python ----------
import rhinoscriptsyntax as rs

for j in range(level):
    vtxCount = rs.MeshVertexCount(mesh)
    vtx = rs.MeshVertices(mesh)
    faceCount = rs.MeshFaceCount(mesh)
    faceNormal = rs.MeshFaceNormals(mesh)
    faceList = []
    
    for i in range(faceCount):
        faceVtx = rs.MeshFaceVertices(mesh)
        vtxIndex1 = faceVtx[i][0]
        vtxIndex2 = faceVtx[i][1]
        vtxIndex3 = faceVtx[i][2]
        vtxIndex4 = faceVtx[i][3]  
        
        v1 = vtx[vtxIndex1]
        v2 = vtx[vtxIndex2]
        v3 = vtx[vtxIndex3]
        v4 = vtx[vtxIndex4]
        
        v5 = v1*0.4+(v2+v3+v4)*0.2+faceNormal[i]*d*(0.5**j)
        v6 = v2*0.4+(v1+v3+v4)*0.2+faceNormal[i]*d*(0.5**j)
        v7 = v3*0.4+(v1+v2+v4)*0.2+faceNormal[i]*d*(0.5**j)
        v8 = v4*0.4+(v1+v2+v3)*0.2+faceNormal[i]*d*(0.5**j)
        
        vtx.append(v5)
        vtxIndex5 = vtxCount
        vtx.append(v6)
        vtxIndex6 = vtxCount+1
        vtx.append(v7)
        vtxIndex7 = vtxCount+2
        vtx.append(v8)
        vtxIndex8 = vtxCount+3
        
        faces = [(vtxIndex1,vtxIndex2,vtxIndex6,vtxIndex5),
        (vtxIndex2,vtxIndex3,vtxIndex7,vtxIndex6),(vtxIndex3,
        vtxIndex4,vtxIndex8,vtxIndex7),(vtxIndex4,
        vtxIndex1,vtxIndex5,vtxIndex8)]
        faceList.extend(faces)
        
        vtxCount = vtxCount+4
    mesh = rs.AddMesh(vtx,faceList)
    
    mesh_out = mesh
# ---------- end ghpython_script_7 ----------
ghpython_script_8 = GhPythonScript(mesh=mesh_plane_7.Mesh)  # -> out, mesh_out; inputs mesh: Mesh; disabled
# ---------- ghpython_script_8: Python ----------
import rhinoscriptsyntax as rs

vtxCount = rs.MeshVertexCount(mesh)
vtx = rs.MeshVertices(mesh)
faceCount = rs.MeshFaceCount(mesh)
faceList = []

for i in range(faceCount):
    faceVtx = rs.MeshFaceVertices(mesh)
    vtxIndex1 = faceVtx[i][0]
    vtxIndex2 = faceVtx[i][1]
    vtxIndex3 = faceVtx[i][2]
    vtxIndex4 = faceVtx[i][3]  
    
    v1 = vtx[vtxIndex1]
    v2 = vtx[vtxIndex2]
    v3 = vtx[vtxIndex3]
    v4 = vtx[vtxIndex4]
    
    v5 = v1*0.4+(v2+v3+v4)*0.2
    v6 = v2*0.4+(v1+v3+v4)*0.2
    v7 = v3*0.4+(v1+v2+v4)*0.2
    v8 = v4*0.4+(v1+v2+v3)*0.2
    
    vtx.append(v5)
    vtxIndex5 = vtxCount
    vtx.append(v6)
    vtxIndex6 = vtxCount+1
    vtx.append(v7)
    vtxIndex7 = vtxCount+2
    vtx.append(v8)
    vtxIndex8 = vtxCount+3
    
    faces = [(vtxIndex1,vtxIndex2,vtxIndex6,vtxIndex5),
    (vtxIndex2,vtxIndex3,vtxIndex7,vtxIndex6),(vtxIndex3,
    vtxIndex4,vtxIndex8,vtxIndex7),(vtxIndex4,
    vtxIndex1,vtxIndex5,vtxIndex8)]
    faceList.extend(faces)
    
    vtxCount = vtxCount+4
mesh = rs.AddMesh(vtx,faceList)

mesh_out = mesh
# ---------- end ghpython_script_8 ----------
ghpython_script_9 = GhPythonScript(mesh=mesh_plane_8.Mesh, level=number_slider_30)  # -> out, mesh_out; inputs mesh: Mesh, level: Int32; disabled
# ---------- ghpython_script_9: Python ----------
import rhinoscriptsyntax as rs

for j in range(level):
    vtxCount = rs.MeshVertexCount(mesh)
    vtx = rs.MeshVertices(mesh)
    faceCount = rs.MeshFaceCount(mesh)
    faceList = []
    
    for i in range(faceCount):
        faceVtx = rs.MeshFaceVertices(mesh)
        vtxIndex1 = faceVtx[i][0]
        vtxIndex2 = faceVtx[i][1]
        vtxIndex3 = faceVtx[i][2]
        vtxIndex4 = faceVtx[i][3]  
        
        v1 = vtx[vtxIndex1]
        v2 = vtx[vtxIndex2]
        v3 = vtx[vtxIndex3]
        v4 = vtx[vtxIndex4]
        
        v5 = v1*0.4+(v2+v3+v4)*0.2
        v6 = v2*0.4+(v1+v3+v4)*0.2
        v7 = v3*0.4+(v1+v2+v4)*0.2
        v8 = v4*0.4+(v1+v2+v3)*0.2
        
        vtx.append(v5)
        vtxIndex5 = vtxCount
        vtx.append(v6)
        vtxIndex6 = vtxCount+1
        vtx.append(v7)
        vtxIndex7 = vtxCount+2
        vtx.append(v8)
        vtxIndex8 = vtxCount+3
        
        faces = [(vtxIndex1,vtxIndex2,vtxIndex6,vtxIndex5),
        (vtxIndex2,vtxIndex3,vtxIndex7,vtxIndex6),(vtxIndex3,
        vtxIndex4,vtxIndex8,vtxIndex7),(vtxIndex4,
        vtxIndex1,vtxIndex5,vtxIndex8)]
        faceList.extend(faces)
        
        vtxCount = vtxCount+4
    mesh = rs.AddMesh(vtx,faceList)
    
    mesh_out = mesh
# ---------- end ghpython_script_9 ----------
mesh_plane_11 = MeshPlane(
    Boundary={Plane=PlaneXY(0, 0, 0), Size=Domain2(u=-10..10, v=-10..10)},
    WidthCount=number_slider_31,
    HeightCount=number_slider_31)  # -> Mesh, Area
ghpython_script_10 = GhPythonScript(mesh=mesh_plane_9.Mesh, level=number_slider_32)  # -> out, mesh_out; inputs mesh: Mesh, level: Int32; disabled
# ---------- ghpython_script_10: Python ----------
import rhinoscriptsyntax as rs

for j in range(level):
    vtxCount = rs.MeshVertexCount(mesh)
    vtx = rs.MeshVertices(mesh)
    faceCount = rs.MeshFaceCount(mesh)
    faceList = []
    
    for i in range(faceCount):
        faceVtx = rs.MeshFaceVertices(mesh)
        vtxIndex1 = faceVtx[i][0]
        vtxIndex2 = faceVtx[i][1]
        vtxIndex3 = faceVtx[i][2]
        vtxIndex4 = faceVtx[i][3]  
        
        v1 = vtx[vtxIndex1]
        v2 = vtx[vtxIndex2]
        v3 = vtx[vtxIndex3]
        v4 = vtx[vtxIndex4]
        
        v5 = (v1+v2)/2
        v6 = (v2+v3)/2
        v7 = (v3+v4)/2
        v8 = (v4+v1)/2
        v9 = (v1+v2+v3+v4)/4
        
        vtx.append(v5)
        vtxIndex5 = vtxCount
        vtx.append(v6)
        vtxIndex6 = vtxCount+1
        vtx.append(v7)
        vtxIndex7 = vtxCount+2
        vtx.append(v8)
        vtxIndex8 = vtxCount+3
        vtx.append(v9)
        vtxIndex9 = vtxCount+4
        
        faces = [(vtxIndex1,vtxIndex5,vtxIndex9,vtxIndex8),
        (vtxIndex2,vtxIndex6,vtxIndex9,vtxIndex5),(vtxIndex3,
        vtxIndex7,vtxIndex9,vtxIndex6),(vtxIndex4,
        vtxIndex8,vtxIndex9,vtxIndex7)]
        faceList.extend(faces)
        
        vtxCount = vtxCount+5
    mesh = rs.AddMesh(vtx,faceList)
    
    mesh_out = mesh
# ---------- end ghpython_script_10 ----------
ghpython_script_11 = GhPythonScript(mesh=mesh_plane_10.Mesh)  # -> out, mesh_out; inputs mesh: Mesh; disabled
# ---------- ghpython_script_11: Python ----------
import rhinoscriptsyntax as rs

vtxCount = rs.MeshVertexCount(mesh)
vtx = rs.MeshVertices(mesh)
faceCount = rs.MeshFaceCount(mesh)
faceList = []

for i in range(faceCount):
    faceVtx = rs.MeshFaceVertices(mesh)
    vtxIndex1 = faceVtx[i][0]
    vtxIndex2 = faceVtx[i][1]
    vtxIndex3 = faceVtx[i][2]
    vtxIndex4 = faceVtx[i][3]  
    
    v1 = vtx[vtxIndex1]
    v2 = vtx[vtxIndex2]
    v3 = vtx[vtxIndex3]
    v4 = vtx[vtxIndex4]
    
    v5 = (v1+v2)/2
    v6 = (v2+v3)/2
    v7 = (v3+v4)/2
    v8 = (v4+v1)/2
    v9 = (v1+v2+v3+v4)/4
    
    vtx.append(v5)
    vtxIndex5 = vtxCount
    vtx.append(v6)
    vtxIndex6 = vtxCount+1
    vtx.append(v7)
    vtxIndex7 = vtxCount+2
    vtx.append(v8)
    vtxIndex8 = vtxCount+3
    vtx.append(v9)
    vtxIndex9 = vtxCount+4
    
    faces = [(vtxIndex1,vtxIndex5,vtxIndex9,vtxIndex8),
    (vtxIndex2,vtxIndex6,vtxIndex9,vtxIndex5),(vtxIndex3,
    vtxIndex7,vtxIndex9,vtxIndex6),(vtxIndex4,
    vtxIndex8,vtxIndex9,vtxIndex7)]
    faceList.extend(faces)
    
    vtxCount = vtxCount+5
mesh = rs.AddMesh(vtx,faceList)

mesh_out = mesh
# ---------- end ghpython_script_11 ----------
mesh_box = MeshBox(
    Base={Plane=PlaneXY(0, 0, 0), X=Domain(-10, 10), Y=Domain(-10, 10), Z=Domain(-10, 10)},
    XCount=number_slider_31,
    YCount=number_slider_31,
    ZCount=number_slider_31)
mesh_sphere_ex = MeshSphereEx(Base=PlaneXY(0, 0, 0), Radius=10, Count=number_slider_31)
mesh_7 = Mesh(ghpython_script_7.mesh_out)
mesh_8 = Mesh(ghpython_script_8.mesh_out)  # disabled
mesh_9 = Mesh(ghpython_script_9.mesh_out)  # disabled
ghpython_script_12 = GhPythonScript(mesh=mesh_sphere_ex, level=Slider(1, range=1..4), d=Slider(9.1, range=0..10))  # -> out, mesh_out; inputs mesh: Mesh, level: Int32; same code as ghpython_script_7
mesh_10 = Mesh(ghpython_script_10.mesh_out)  # disabled
mesh_11 = Mesh(ghpython_script_11.mesh_out)  # disabled
mesh_12 = Mesh(ghpython_script_12.mesh_out)

ghpython_script_13 = GhPythonScript(mesh=mesh_plane_4.Mesh)  # -> out, vertices_out, vertexCount_out; inputs mesh: Mesh; disabled
# ---------- ghpython_script_13: Python ----------
import rhinoscriptsyntax as rs

vertices = rs.MeshVertices(mesh)
vertices_out = vertices

vertexCount = rs.MeshVertexCount(mesh)
vertexCount_out = vertexCount
# ---------- end ghpython_script_13 ----------
ghpython_script_14 = GhPythonScript(mesh=mesh_plane_5.Mesh)  # -> out, faceCount_out, faceNormals_out, faceVertices_out; inputs mesh: Mesh; disabled
# ---------- ghpython_script_14: Python ----------
import rhinoscriptsyntax as rs

faceCount = rs.MeshFaceCount(mesh)
faceCount_out = faceCount

faceNormals = rs.MeshFaceNormals(mesh)
faceNormals_out = faceNormals

faceVertices = rs.MeshFaceVertices(mesh)
faceVertices_out = faceVertices
# ---------- end ghpython_script_14 ----------
point_list = PointList(Points=square.Points)  # disabled
point_list_2 = PointList(Points=square_2.Points)  # disabled
ghpython_script_15 = GhPythonScript(vertices=square.Points, a=number_slider_21, b=number_slider_23, c=number_slider_24, d=number_slider_22)  # -> out, mesh_out; inputs vertices: list of Point3d, a: Int32, b: Int32, c: Int32, d: Int32; disabled
# ---------- ghpython_script_15: Python ----------
import rhinoscriptsyntax as rs

faces = [(a,b,c,d),((a+b),(b+c),(c+d),(d+a)),((a+b+c),(b+c+d),(c+d+a),(d+a+b))]
mesh = rs.AddMesh(vertices,faces)
mesh_out = mesh
# ---------- end ghpython_script_15 ----------
panel_4 = Panel(ghpython_script_14.faceCount_out)  # disabled
panel_5 = Panel(ghpython_script_13.vertexCount_out)  # disabled
mesh_13 = Mesh(graft(ghpython_script_15.mesh_out))  # disabled
panel_6 = Panel(ghpython_script_14.faceNormals_out)  # disabled
panel_7 = Panel(ghpython_script_14.faceVertices_out)  # disabled
param_viewer = ParamViewer(mesh_13)  # disabled
panel_8 = Panel(ghpython_script_13.vertices_out)  # disabled
mesh_union = MeshUnion(Meshes=mesh_13)  # disabled
panel_9 = Panel(mesh_13)  # disabled
weld_mesh = WeldMesh(Mesh=mesh_union, Angle=3.141592654)  # disabled
panel_10 = Panel(weld_mesh)  # disabled
mesh_edges = MeshEdges(Mesh=weld_mesh)  # -> NakedEdges, InteriorEdges, NonManifoldEdges; disabled
join_curves = JoinCurves(Curves=mesh_edges.NakedEdges, Preserve=False)  # disabled
boundary_surfaces = BoundarySurfaces(Edges=join_curves)  # disabled
unit_z = UnitZ(Factor=number_slider_5)  # disabled
unit_z_2 = UnitZ(Factor=number_slider_6)  # disabled
number_slider_33 = Slider(48, range=0..100)  # disabled
number_slider_34 = Slider(45, range=0..100)  # disabled
number_slider_35 = Slider(17, range=0..100)  # disabled
number_slider_36 = Slider(27, range=0..100)  # disabled
ghpython_script_16 = GhPythonScript(vertices=square_2.Points, a=number_slider_33, b=number_slider_34, c=number_slider_35, d=number_slider_36)  # -> out, mesh_out; inputs vertices: list of Point3d, a: Int32, b: Int32, c: Int32, d: Int32; disabled
# ---------- ghpython_script_16: Python ----------
import rhinoscriptsyntax as rs

faces = [(a,b,c,d),((a+b),(b+c),(c+d),(d+a))]
mesh = rs.AddMesh(vertices,faces)
mesh_out = mesh
# ---------- end ghpython_script_16 ----------
mesh_14 = Mesh(graft(ghpython_script_16.mesh_out))  # disabled
param_viewer_2 = ParamViewer(mesh_14)  # disabled
mesh_union_2 = MeshUnion(Meshes=mesh_14)  # disabled
panel_11 = Panel(mesh_14)  # disabled
weld_mesh_2 = WeldMesh(Mesh=mesh_union_2, Angle=3.141592654)  # disabled
panel_12 = Panel(weld_mesh_2)  # disabled
mesh_edges_2 = MeshEdges(Mesh=weld_mesh_2)  # -> NakedEdges, InteriorEdges, NonManifoldEdges; disabled
join_curves_2 = JoinCurves(Curves=mesh_edges_2.NakedEdges, Preserve=False)  # disabled
boundary_surfaces_2 = BoundarySurfaces(Edges=join_curves_2)  # disabled
extrude = Extrude(Base=boundary_surfaces, Direction=unit_z)  # disabled
extrude_2 = Extrude(Base=boundary_surfaces_2, Direction=unit_z_2)  # disabled
explode_tree = ExplodeTree(Data=graft(extrude))  # -> _00000, Branch1, Branch2, Branch3, Branch4, Branch5, Branch6; disabled
explode_tree_2 = ExplodeTree(Data=graft(extrude_2))  # -> _00000, _00001, _00002, Branch3, Branch4, Branch5, Branch6; disabled
geometry = Geometry(explode_tree.Branch1)  # disabled
geometry_2 = Geometry(explode_tree.Branch3)  # disabled
geometry_3 = Geometry(explode_tree.Branch4)  # disabled
geometry_4 = Geometry(explode_tree.Branch5)  # disabled
geometry_5 = Geometry(explode_tree._00000)  # disabled
geometry_6 = Geometry(explode_tree.Branch2)  # disabled
geometry_7 = Geometry(explode_tree_2._00000)  # disabled
geometry_8 = Geometry(explode_tree_2._00001)  # disabled
geometry_9 = Geometry(explode_tree_2.Branch3)  # disabled
geometry_10 = Geometry(explode_tree_2.Branch4)  # disabled
geometry_11 = Geometry(explode_tree_2.Branch5)  # disabled
geometry_12 = Geometry(explode_tree_2._00002)  # disabled
