# Grasshopper definition 03_Rhino_Grasshopper_Python_WickersonStudios_Geometry_Mesh_Create_3.0_Revit2021_026.gh (Grasshopper 1.0.7)
# Copyright: bernhard muller bijoutiers
# plug-ins: Workshop, Bifocals

# www.wickersonstudios.com
# gitHub: Mwickerson
# Mesh Verticies
wickerson_s_first_grasshopper_component = WickersonsFirstGrasshopperComponent()
# Mesh Face
number_slider = Slider(2, range=0..10)  # disabled
# Mesh Create
number_slider_2 = Slider(2, range=0..10)  # disabled
boundary = Boundary({Plane=PlaneXY(52.03645833, 51.76822917, 0), Size=Domain2(u=-92.00520833..92.00520833, v=-86.88802083..86.88802083)})  # disabled
boundary_2 = Boundary({Plane=PlaneXY(52.03645833, 51.76822917, 0), Size=Domain2(u=-92.00520833..92.00520833, v=-86.88802083..86.88802083)})  # disabled
mesh_plane = MeshPlane(Boundary=boundary, WidthCount=number_slider, HeightCount=number_slider)  # -> Mesh, Area; disabled
mesh_plane_2 = MeshPlane(Boundary=boundary_2, WidthCount=number_slider_2, HeightCount=number_slider_2)  # -> Mesh, Area; disabled
square = Square(Plane=PlaneXY(0, 0, 0), Size=1, ExtentX=Slider(10, range=0..10), ExtentY=Slider(10, range=0..10))  # -> Cells, flatten(Points)
ghpython_script = GhPythonScript(mesh=mesh_plane.Mesh)  # -> out, vertices_out, vertexCount_out; inputs mesh: Mesh; disabled
# ---------- ghpython_script: Python ----------
import rhinoscriptsyntax as rs

vertices = rs.MeshVertices(mesh)
vertices_out = vertices

vertexCount = rs.MeshVertexCount(mesh)
vertexCount_out = vertexCount
# ---------- end ghpython_script ----------
ghpython_script_2 = GhPythonScript(mesh=mesh_plane_2.Mesh)  # -> out, faceCount_out, faceNormals_out, faceVertices_out; inputs mesh: Mesh; disabled
# ---------- ghpython_script_2: Python ----------
import rhinoscriptsyntax as rs

faceCount = rs.MeshFaceCount(mesh)
faceCount_out = faceCount

faceNormals = rs.MeshFaceNormals(mesh)
faceNormals_out = faceNormals

faceVertices = rs.MeshFaceVertices(mesh)
faceVertices_out = faceVertices
# ---------- end ghpython_script_2 ----------
point_list = PointList(Points=square.Points)
panel = Panel(ghpython_script_2.faceCount_out)  # disabled
panel_2 = Panel(ghpython_script.vertexCount_out)  # disabled
panel_3 = Panel(ghpython_script_2.faceNormals_out)  # disabled
panel_4 = Panel(ghpython_script_2.faceVertices_out)  # disabled
panel_5 = Panel(ghpython_script.vertices_out)  # disabled
unit_z = UnitZ(Factor=Slider(2, range=0..10))
ghpython_script_3 = GhPythonScript(
    vertices=square.Points,
    a=Slider(74, range=0..100),
    b=Slider(13, range=0..100),
    c=Slider(69, range=0..100),
    d=Slider(26, range=0..100))  # -> out, mesh_out; inputs vertices: list of Point3d, a: Int32, b: Int32, c: Int32, d: Int32
# ---------- ghpython_script_3: Python ----------
import rhinoscriptsyntax as rs

faces = [(a,b,c,d),((a+b),(b+c),(c+d),(d+a))]
mesh = rs.AddMesh(vertices,faces)
mesh_out = mesh
# ---------- end ghpython_script_3 ----------
mesh = Mesh(graft(ghpython_script_3.mesh_out))
param_viewer = ParamViewer(mesh)
mesh_union = MeshUnion(Meshes=mesh)
panel_6 = Panel(mesh)
weld_mesh = WeldMesh(Mesh=mesh_union, Angle=3.141592654)
panel_7 = Panel(weld_mesh)
mesh_edges = MeshEdges(Mesh=weld_mesh)  # -> NakedEdges, InteriorEdges, NonManifoldEdges
join_curves = JoinCurves(Curves=mesh_edges.NakedEdges, Preserve=False)
boundary_surfaces = BoundarySurfaces(Edges=join_curves)
extrude = Extrude(Base=boundary_surfaces, Direction=unit_z)
explode_tree = ExplodeTree(Data=graft(extrude))  # -> _00000, _00001, _00002, _00003
geometry = Geometry(explode_tree._00000)
geometry_2 = Geometry(explode_tree._00002)
geometry_3 = Geometry(explode_tree._00001)
geometry_4 = Geometry(explode_tree._00003)
