# Grasshopper definition 03_Rhino_Grasshopper_Python_WickersonStudios_Geometry_Mesh_Face_3.0_Revit2021_025.gh (Grasshopper 1.0.7)
# Copyright: bernhard muller bijoutiers
# plug-ins: Workshop, Bifocals

# www.wickersonstudios.com
# gitHub: Mwickerson
# Mesh Verticies
wickerson_s_first_grasshopper_component = WickersonsFirstGrasshopperComponent()
# Mesh Face
number_slider = Slider(2, range=0..10)  # disabled
number_slider_2 = Slider(2, range=0..10)
boundary = Boundary({Plane=PlaneXY(52.03645833, 51.76822917, 0), Size=Domain2(u=-92.00520833..92.00520833, v=-86.88802083..86.88802083)})  # disabled
boundary_2 = Boundary({Plane=PlaneXY(52.03645833, 51.76822917, 0), Size=Domain2(u=-92.00520833..92.00520833, v=-86.88802083..86.88802083)})
mesh_plane = MeshPlane(Boundary=boundary, WidthCount=number_slider, HeightCount=number_slider)  # -> Mesh, Area; disabled
mesh_plane_2 = MeshPlane(Boundary=boundary_2, WidthCount=number_slider_2, HeightCount=number_slider_2)  # -> Mesh, Area
ghpython_script = GhPythonScript(mesh=mesh_plane.Mesh)  # -> out, vertices_out, vertexCount_out; inputs mesh: Mesh; disabled
# ---------- ghpython_script: Python ----------
import rhinoscriptsyntax as rs

vertices = rs.MeshVertices(mesh)
vertices_out = vertices

vertexCount = rs.MeshVertexCount(mesh)
vertexCount_out = vertexCount
# ---------- end ghpython_script ----------
ghpython_script_2 = GhPythonScript(mesh=mesh_plane_2.Mesh)  # -> out, faceCount_out, faceNormals_out, faceVertices_out; inputs mesh: Mesh
# ---------- ghpython_script_2: Python ----------
import rhinoscriptsyntax as rs

faceCount = rs.MeshFaceCount(mesh)
faceCount_out = faceCount

faceNormals = rs.MeshFaceNormals(mesh)
faceNormals_out = faceNormals

faceVertices = rs.MeshFaceVertices(mesh)
faceVertices_out = faceVertices
# ---------- end ghpython_script_2 ----------
panel = Panel(ghpython_script_2.faceCount_out)
panel_2 = Panel(ghpython_script.vertexCount_out)  # disabled
panel_3 = Panel(ghpython_script_2.faceNormals_out)
panel_4 = Panel(ghpython_script_2.faceVertices_out)
panel_5 = Panel(ghpython_script.vertices_out)  # disabled
